# Grasshopper definition SHELLS_ACORN_master_2021.gh (Grasshopper 1.0.7)
# plug-ins: Capture, Sift, Kiwi3d, ACORNshells, Sampler, karambaGH

image = ImageSampler(Filter="Colour", Interpolate=False, Umax=1, Umin=0, Vmax=1, Vmin=0, Wrap=1)
thickness = Slider(0.02, range=0.02..0.12)
height = Slider(0.2, range=0..1)
number_slider = Slider(0.25, range=0..1)
polygon = Polygon(Plane=PlaneXY(0, 0, 0), Radius=3, Segments=Slider(5, range=3..6), FilletRadius=0)  # -> Polygon, Length

# ---- group: just because of squares
pi = Pi(Factor=".25")
rotate = Rotate(Geometry=polygon.Polygon, Angle=pi, Plane=PlaneXY(0, 0, 0))  # -> Geometry, Transform

# ----
pt = Point([Point(-2.65739868, 2.586695785, 0), Point(2.522828173, 2.363083722, 0), Point(4.069487342, -3.772482641, 0), Point(-1.375177545, -2.361354304, 0)])
pt_2 = Point([Point(0, 0, 0), Point(8, 0, 0), Point(6, 6, 0), Point(0, 6, 0)])
square_edge_length = Number(Slider(2, range=0..10))
pline = PolyLine(Vertices=pt_2, Closed=True)
rectangle = Rectangle(Plane=PlaneXY(0, 0, 0), XSize=Slider(7.8, range=0..10), YSize=Slider(7.2, range=0..10), Radius=0)  # -> Rectangle, Length
rectangle_2 = Rectangle(Plane=PlaneXY(0, 0, 0), XSize=square_edge_length, YSize=square_edge_length, Radius=0)  # -> Rectangle, Length
merge = Merge(Data1=Slider(5, range=5..10), Data2=height, Data3=thickness)
rectangle_3 = Curve(rectangle.Rectangle)
regular_polygon = Curve(rotate.Geometry)
square = Curve(rectangle_2.Rectangle)
irregular_quad = Curve(pline)
item = ListItem(List=merge, Index=0, Wrap=True)  # -> Item, Item1, Item2
thickness_m = Number(item.Item2)
span_m = Number("1")
height_m = Number(item.Item1)
filter = StreamFilter(Gate=Slider(1, range=0..10), Stream0=rectangle_3, Stream1=square, Stream2=regular_polygon, Stream3=irregular_quad)

# ---- group: center at 0,0,0
crv = Curve(filter)
area = Area(Geometry=crv)  # -> Area, Centroid
rev = Reverse(Vector=area.Centroid)
move = Move(Geometry=crv, Motion=rev)  # -> Geometry, Transform

# ----
bay_geometry = Geometry(move.Geometry)

# ---- group: Generate plan
number_slider_2 = Slider(0.2, range=0..1)
a_makeshellplan = MakeShellPlan(Outline=bay_geometry, CornerRadius=number_slider_2, CurvedCorner=Toggle(False))

# ----
number_slider_3 = Slider(36, range=0..100)
lor_7_8x7_2 = Surface(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)
_6x6 = Surface(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)
srf = Surface(a_makeshellplan)
shell = Surface(srf)  # disabled

# ----
# Kiwi Membrane
# fixed edges - DEBUGGING
shell_2 = Surface(shell)  # disabled
edges = BrepEdges(Brep=shell_2)  # -> Naked, Interior, NonManifold; disabled
len = Length(Curve=edges.Naked)  # disabled
height_m_2 = Number(height_m)  # disabled
lng = ListLength(List=edges.Naked)  # disabled
sort = SortList(Keys=len, ValuesA=edges.Naked)  # -> Keys, ValuesA; disabled
division = Division(A=lng, B=2)  # disabled
height_m_3 = Number(height_m_2)  # disabled
srf_2 = Surface(shell_2)  # disabled
split = SplitList(List=sort.ValuesA, Index=division)  # -> ListA, ListB; disabled
corners = Curve(split.ListA)  # disabled
edges_2 = Curve(split.ListB)  # disabled
corners_2 = Curve(corners)  # disabled
edges_3 = Curve(edges_2)  # disabled
brep = Brep(srf_2)  # disabled
corners_3 = Curve(corners_2)  # disabled
edges_4 = Curve(edges_3)  # disabled
panel = Panel("8")  # disabled
debrep = DeconstructBrep(Brep=brep)  # -> Faces, Edges, Vertices; disabled
pframes = PerpFrames(Curve=edges_4, Count=panel, Align=True)  # -> simplify(Frames), Parameters; disabled
list = ValueList({"STEEL": 1, "WOOD": 2, "GFRP": 3, "ETFE (Membrane)": 4, "CONCRETE": 5, "ALUMINIUM": 6}, selected="ETFE (Membrane)")  # disabled
panel_2 = Panel("0")  # disabled
cull_i = CullIndex(List=pframes.Frames, Indices=panel_2, Wrap=True)  # disabled
pt_3 = Point(debrep.Vertices)  # disabled
cull_i_2 = CullIndex(List=reverse(cull_i), Indices=panel_2, Wrap=True)  # -> simplify(List); disabled
matdef = MaterialDefaults(Type=list, IsNmm2=False, IskNcm2=False, IskNm2=True, mUnit=1)  # -> Material, YoungsModulus, AlphaT, Nue, Density, Strength; disabled
number_slider_4 = Slider(0.13, range=0..1)  # disabled
deplane = DeconstructPlane(Plane=cull_i_2)  # -> Origin, XAxis, YAxis, ZAxis; disabled
Y = UnitY(Factor=1)  # disabled
cable_prestress = Slider(0.1, range=0..0.5)  # disabled
load = Slider(0.095, range=0.005..0.095)  # disabled
X = UnitX(Factor=1)  # disabled
number_slider_5 = Slider(0.3, range=0..1)  # disabled
number_slider_6 = Slider(5, range=0..10)  # disabled
list_2 = ValueList({"STEEL": 1, "WOOD": 2, "GFRP": 3, "ETFE (Membrane)": 4, "CONCRETE": 5, "ALUMINIUM": 6}, selected="STEEL")  # disabled
dprod = DotProduct(VectorA=Y, VectorB=deplane.YAxis, Unitize=False)  # disabled
dprod_2 = DotProduct(VectorA=X, VectorB=deplane.YAxis, Unitize=False)  # disabled
multiplication = Multiplication(A=number_slider_4, B=height_m_3)  # disabled
list_3 = ValueList({"DEAD": 1, "SNOW": 2, "PRES": 3, "PRES_FL": 4}, selected="DEAD")  # disabled
panel_3 = Panel("FormFinding")  # disabled
list_4 = ValueList({"Displacements": 1, "Stresses": 2, "SupportForces": 3}, selected="Displacements")  # disabled
Z = UnitZ(Factor=1)  # disabled
toggle = BooleanToggle(False)  # disabled
load_2 = Number(load)  # disabled
panel_4 = Panel("8")  # disabled
prestress = Number(number_slider_5)  # disabled
srfref = SurfaceRefinement(PDeg=3, QDeg=3, IsKnotApproxElementSize=False, IsKnotSubdivision=True)  # disabled
abs = Absolute(Value=dprod)  # disabled
abs_2 = Absolute(Value=dprod_2)  # disabled
prestress_cable = Number(cable_prestress)  # disabled
matdef_2 = MaterialDefaults(Type=list_2, IsNmm2=False, IskNcm2=False, IskNm2=True, mUnit=1)  # -> Material, YoungsModulus, AlphaT, Nue, Density, Strength; disabled
crvref = CurveRefinement(PDeg=3, MinElementsU=panel_4, IsKnotApproxElementSize=False, IsKnotSubdivision=True)  # disabled
crv_2 = Curve(edges_4)  # disabled
supcrv = SupportCurve(Crv=corners_3, DispX=True, DispY=True, DispZ=True, Rot=False)  # disabled
suppt_constrain_edges = SupportPoint(Point=deplane.Origin, DispX=abs_2, DispY=abs, DispZ=toggle, Rotation=False, Torsion=False)  # disabled
srfload = SurfaceLoad(Brep=srf_2, Loadtype=list_3, Direction=Z, Value=load_2, LoadCase=1)  # disabled
membrane = MembraneElement(
    Brep=srf_2,
    Material=matdef.Material,
    Thickness=multiplication,
    Prestress1=prestress,
    Prestress2=prestress,
    Refinement=srfref,
    Formfinding=True,
    ShowPrestressDirections=False)  # disabled
fofi = Formfinding(Name=panel_3, FormfindingSteps=number_slider_6, Iterations=number_slider_6, OutputSetting=list_4)  # disabled
cable = CableElement(
    Curve=crv_2,
    Material=matdef_2.Material,
    Diameter=0.01,
    Prestress=prestress_cable,
    PrestressControl=False,
    CurveRefinement=crvref,
    Formfinding=True)  # disabled
path_mapper = PathMapper(suppt_constrain_edges, source="{A;B} (C)", target="{A;C} (B)")  # disabled
merge_2 = Merge(Data1=membrane, Data2=cable)  # -> flatten(Result); disabled
item_2 = ListItem(List=path_mapper, Index=0, Wrap=True)  # disabled
merge_3 = Merge(Data1=item_2, Data2=supcrv)  # -> flatten(Result); disabled
panel_5 = Panel("C:\Users\ec977\OneDrive - University of Bath\Eduardo\_DEVELOPMENT\__ PINBED SHELL\kiwiDump")  # disabled
button = Button()  # disabled
amodel = AnalysisModel(
    Analysis=fofi,
    StructuralElements=merge_2,
    Supports=merge_3,
    Loads=srfload,
    IntersectionTolerance=0.001,
    IsCarat=True,
    IsKratos=False,
    PenaltyFac=10000000,
    ShowCouplingIDs=False,
    ShowEdgeIDs=False,
    ShowGeo=True,
    ShowPatchIDs=True,
    ShowPrePro=True,
    ShowRef=False)  # disabled
run_analysis = IGASolver(AnalysisModel=amodel, Path=panel_5, Run=button, antiFreeze=False, showWindow=True)  # -> ResultModel, ErrorReport; disabled

# ---- group: Scale deformed shell to target height
defmod = DeformedModel(Model=run_analysis.ResultModel, ScaleFactor=1, FlyingNodeLimit=100000)  # -> Model, Geo, DeformedStructuralElements; disabled
item_3 = ListItem(List=defmod.Geo, Index=0, Wrap=True)  # disabled
shell_3 = Surface(item_3)  # disabled
bbox = BoundingBox(Content=shell_3, Plane=PlaneXY(0, 0, 0))  # -> Box, Box_2; disabled
boxsize = BoxSize(box=bbox.Box)  # -> X_2, Y_2, Z_2, A_2, V_2; disabled
height_m_4 = Number(height_m_3)  # disabled
panel_6 = Panel(boxsize.Z_2)  # disabled
division_2 = Division(A=height_m_4, B=boxsize.Z_2)  # disabled
defmod_2 = DeformedModel(Model=defmod.Model, ScaleFactor=division_2, FlyingNodeLimit=100000)  # -> Model, Geo, DeformedStructuralElements; disabled
panel_7 = Panel(division_2)  # disabled
item_4 = ListItem(List=defmod_2.Geo, Index=0, Wrap=True)  # disabled
shell_4 = Surface(item_4)  # disabled

# ----
multipatch_gh = MultiPatchGH(bay_geometry=bay_geometry, shell_plan=srf)  # disabled
neg = Negative(Value=Slider(2, range=0..10))
number_slider_7 = Slider(6, range=1..12)  # disabled
_10º = PowerOf10(Value=neg)
multiplication_2 = Multiplication(A=Slider(1.5, range=1..10), B=_10º)
tested_anna_bauer = Panel("0.013")
panel_8 = Panel(multiplication_2)
load_3 = Number(multiplication_2)
membrane_prestress_u = Slider(0.475, range=0..0.5)
membrane_prestress_v = Slider(0.15, range=0..0.5)
cable_prestress_2 = Slider(0.95, range=0..1)
load_4 = Slider(0.0875, range=0.08..0.12)
panel_9 = Panel("0.15")
panel_10 = Panel("0.084")
prestress_cable_2 = Number(cable_prestress_2)
prestress_u = Number(membrane_prestress_u)
prestress_v = Number(membrane_prestress_u)
load_5 = Number(load_4)

# ---- group: Form finding - Mish's values
supportcurve = BooleanToggle(False)
scaledeform = BooleanToggle(False)
height_m_5 = Number(height_m)
a_formfindkiwi = FormFindKiwi(
    PlanShell=srf,
    Height=height_m_5,
    SubDiv=Slider(30, range=0..100),
    Run=Button(),
    CurveSupports=supportcurve,
    ScaleDeform=scaledeform,
    ThicknessFactor=Slider(0.1, range=0..1))  # -> KiwiErrors, FormFoundShell; disabled

# ----
scaledeform_2 = BooleanToggle(True)

# ---- group: Form finding - LoR values
supportcurve_2 = BooleanToggle(True)
height_m_6 = Number(height_m)
a_formfindkiwi_2 = FormFindKiwi(
    PlanShell=srf,
    Height=height_m_6,
    SubDiv=Slider(10, range=0..100),
    Run=Button(),
    CurveSupports=supportcurve_2,
    ScaleDeform=scaledeform_2,
    ThicknessFactor=Slider(0.125, range=0..0.2))  # -> KiwiErrors, FormFoundShell

# ---- group: Formfinding - membrane
supportcurve_3 = BooleanToggle(False)
scaledeform_3 = BooleanToggle(True)
height_m_7 = Number(height_m)
a_formfindmembrane = FormFindMembrane(
    PlanShell=srf,
    MultiplePatches=multipatch_gh,
    Height=height_m_7,
    SubDiv=Slider(10, range=0..100),
    Run=Button(),
    CurveSupports=supportcurve_3,
    ScaleDeform=scaledeform_3,
    ThicknessFactor=Slider(0.13, range=0..1),
    MembranePrestressU=prestress_u,
    MembranePrestressV=prestress_v,
    CablePrestressV=prestress_cable_2,
    Load=load_5,
    PlanarEdges=Toggle(True),
    UpdateOnChange=Toggle(False))  # -> KiwiErrors, FormFoundShell

# ----
geo = Geometry()
geo_2 = Geometry(a_formfindmembrane.FormFoundShell)
geo_cable_prestress_01 = Geometry(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)
geo_cable_prestress_5 = Geometry(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)
geo_cable_prestress_05 = Geometry(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)
geo_cable_prestress_1 = Geometry(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)
geo_cable_prestress_2 = Geometry(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)
# cable prestress 0.1
# load 0.015
_1st_ff_membrane = Data(Tree({0}: [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], {1}: [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], {2}: [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]))
# cable prestress 1.70
# load 0.015
_2nd_ff_membrane = Data(Tree({0}: [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], {1}: [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], {2}: [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]))
ff_replicated_lor = Data(Tree({0}: [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], {1}: [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], {2}: [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]))
lor_7_8x7_2_2 = Surface(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)
merge_4 = Merge(
    Data1=geo_cable_prestress_5,
    Data2=geo_cable_prestress_2,
    Data3=geo_cable_prestress_1,
    Data4=geo_cable_prestress_05,
    Data5=geo_cable_prestress_01)
lng_2 = ListLength(List=merge_4)
series = Series(Start=0, Step=Slider(3, range=0..10), Count=lng_2)
vec = VectorXYZ(XComponent=series, YComponent=series, ZComponent=0)  # -> Vector, Length
move_2 = Move(Geometry=merge_4, Motion=vec.Vector)  # -> Geometry, Transform

# ---- group: GH variable thickness
srf_good_for_99_comp = Surface(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)
shell_5 = Brep(geo_2)
srf_good_for_buck = Surface(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)
extra_thickness = Slider(0.019, range=0..0.02)
srf_3 = Surface(shell_5)
base_thickness = Slider(0.02, range=0..1)
number_slider_8 = Slider(0.193, range=0..1)
c_variable_thickness_shell = CSharpScript(S=srf_3, bT=number_slider_8, eT=number_slider_8, L=Slider(0.716, range=0..2))  # -> out, T, P; inputs S: Brep, bT: Double, eT: Double, L: Double
# ---------- c_variable_thickness_shell: C# usings ----------
using System.Linq;
# ---------- c_variable_thickness_shell: C# ----------
    // get trim information from S, to re-apply to all with Brep.CreateTrimmedSurface
    BrepFace trimmedSurface = S.Faces[0];
    Surface origSrf = trimmedSurface.ToNurbsSurface();
    Curve trimCurve = trimmedSurface.OuterLoop.To3dCurve();

    // get uv coordinates for corner curves midpoints
    //Curve[] srfEdges = trimCurve.DuplicateSegments();
    List<Point2d> suppUVs = new List<Point2d>();
    //List<Point3d> suppPTs = new List<Point3d>(); // test
    //List<Point3d> pushPTs = new List<Point3d>(); // test

    List <Curve> corners = new List <Curve> ();
    List <Curve> edges = new List <Curve> ();
    GetShellEdges(S, out corners, out edges); //edges not used, but out _ was not working
    foreach (Curve corner in corners)
    {
      //get midpoint
      Point3d thickPt = corner.PointAtNormalizedLength(.5);
      //suppPts.Add(thickPt);

      Point3d closestPoint; //not used, but out _ was not working
      ComponentIndex ci;
      double s;
      double t;
      Vector3d normal = new Vector3d();

      origSrf.ToBrep().ClosestPoint
        (thickPt,
        out closestPoint,
        out ci,
        out s,
        out t,
        1.0, //double maximumDistance,
        out normal);
      suppUVs.Add(new Point2d(s, t));
      //suppPTs.Add(origSrf.PointAt(s, t)); //test

    }


    int layerCount = 3; // includes original

    //Surface origSrf = trimmedSurface.ToNurbsSurface();
    double baseThickness = bT;
    double extraThickness = eT;
    double length = L; // calculate from shell span

    //Point2d uv00 = new Point2d(origSrf.Domain(0).ParameterAt(0), origSrf.Domain(1).ParameterAt(0)); //iterate
    //Point2d uv01 = new Point2d(origSrf.Domain(0).ParameterAt(0), origSrf.Domain(1).ParameterAt(1)); //iterate
    //Point2d uv11 = new Point2d(origSrf.Domain(0).ParameterAt(1), origSrf.Domain(1).ParameterAt(1)); //iterate
    //Point2d uv10 = new Point2d(origSrf.Domain(0).ParameterAt(1), origSrf.Domain(1).ParameterAt(0)); //iterate

    Vector3d delta = new Vector3d (0, 0, -extraThickness); // calculate surface normal instead...
    double uLength = length;
    double vLength = length;
    double tolerance = RhinoDoc.ActiveDoc.ModelAbsoluteTolerance;

    List<Brep> layers = new List<Brep>();
    //List<Point3d> pushedPTs = new List<Point3d>(); // test
    for (int i = 0; i < layerCount; i++)
    {
      double layerThickness = i * baseThickness / (layerCount - 1);
      Vector3d layerDelta = new Vector3d (0, 0, -(i * extraThickness / (layerCount - 1)));
      Surface currSrf = origSrf;

      /*
      foreach (Point3d suppPT in suppPTs)
      {
        Point3d pushPT = suppPT + delta;
        //pushPT = delta));
        pushPTs.Add(pushPT);
      }
      */

      foreach (Point2d suppUV in suppUVs)
        currSrf = Surface.CreateSoftEditSurface(currSrf, suppUV, layerDelta, uLength, vLength, tolerance, false);

      //currSrf = Surface.CreateSoftEditSurface(currSrf, uv00, layerDelta, uLength, vLength, tolerance, false);
      //currSrf = Surface.CreateSoftEditSurface(currSrf, uv01, layerDelta, uLength, vLength, tolerance, false);
      //currSrf = Surface.CreateSoftEditSurface(currSrf, uv11, layerDelta, uLength, vLength, tolerance, false);
      //currSrf = Surface.CreateSoftEditSurface(currSrf, uv10, layerDelta, uLength, vLength, tolerance, false);

      currSrf.Translate(0, 0, -layerThickness);
      Curve[] projectedTrimCurves = Curve.ProjectToBrep(trimCurve, currSrf.ToBrep(), new Vector3d (0, 0, -1), tolerance);
      Brep currSurfTrimmed = currSrf.ToBrep().Split(projectedTrimCurves, tolerance)[1];
      layers.Add(currSurfTrimmed);
    }

    T = layers;
    //P = pushPTs;
# ---------- c_variable_thickness_shell: C# additional code ----------
  // in SHELLScommon, do not copy
  public static void GetShellEdges(Brep shell, out List<Curve> corners, out List<Curve> edges)
  {
    var shellAllEdges = shell.Edges;
    // sort edges by length
    List<BrepEdge> sortedAllEdges = shellAllEdges.OrderBy(s => s.GetLength()).ToList();
    // get 50% shortest edges
    corners = new List<Curve>();
    edges = new List<Curve>();
    int numAllEdges = sortedAllEdges.Count;
    for (int i = 0; i < numAllEdges / 2; i++) corners.Add(sortedAllEdges[i].EdgeCurve); // equivalent to GetRange(0,halfEdgeCount)
    for (int i = numAllEdges / 2; i < numAllEdges; i++) edges.Add(sortedAllEdges[i].EdgeCurve);

  }
# ---------- end c_variable_thickness_shell ----------
surfgriller = SurfGriller(surface=c_variable_thickness_shell.T, grid_lines=Slider(10, range=0..10))
geo_3 = Geometry(c_variable_thickness_shell.P)
item_5 = ListItem(List=c_variable_thickness_shell.T, Index=0, Wrap=True)  # -> Item, Item1, Item2
srf_4 = Surface(item_5.Item)
srf_5 = Surface(item_5.Item1)
srf_6 = Surface(item_5.Item2)
shell_6 = Brep(srf_5)

# ----
list_5 = ValueList({"Random": 0, "Grid": 1, "Latin hypercube": 2}, selected="Grid")
sampler = Sampler(
    Variables=[membrane_prestress_u, cable_prestress_2, extra_thickness],
    Samples="1000",
    Type=list_5,
    Seed="0",
    Directory="None")  # -> DesignMap, Data
panel_11 = Panel(sampler.DesignMap)
sift = Sift(Variables=[membrane_prestress_u, cable_prestress_2], DesignMap=sampler.DesignMap, Index=Slider(9, range=0..10))  # disabled
shell_7 = Brep(geo_2)  # disabled

# ----
# .15 membrane and cable prestress
# .015 load
ff_membrane = Data(Tree({0}: [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], {1}: [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], {2}: [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]))

# ---- group: Preliminary analysis
mesh_breps = MeshBrepsKaramba3D(
    Brep=shell_7,
    MeshResolution=Slider(0.1, range=0..1),
    EdgeRefinementFactor=0.67,
    PointReduction=Toggle(False),
    SmoothingStepSize=Slider(1, range=0..1),
    SmoothingIterations=Slider(1, range=0..10))  # -> Mesh, Info
thickness_m_2 = Number(thickness_m)
a_preliminaryshellanalysismodel = PreliminaryShellAnalysisModel(ShellSurface=shell_7, Mesh=mesh_breps.Mesh, Thickness=thickness_m_2)
analyze = AnalyzeKaramba3D(Model=a_preliminaryshellanalysismodel)  # -> CalculatedModel, MaximumDisplacement_cm, ResultingForceOfGravity_kN, ElasticEnergy_kNm

# ----
panel_12 = Panel(sift)
number_slider_9 = Slider(0.06, range=0..0.1)

# ---- group: Segment shell
a_stresslines = StressLines(
    Model=analyze.CalculatedModel,
    Shell=shell_7,
    KeystoneWidth=Slider(2, range=0..2),
    CornerstoneWidth=Slider(2, range=0..2),
    LengthParam1=Slider(2.7, range=0..3),
    LengthParam2=Slider(1.5, range=0..3))  # -> StressLines1, StressLines2, CableProfiles1, CableProfiles2
a_segment = Segment(Shell=shell_7, StressLines1=a_stresslines.StressLines1, StressLines2=a_stresslines.StressLines2)

# ----
entwine = Entwine(Branch00=a_stresslines.CableProfiles2, Branch01=a_stresslines.CableProfiles1, FlattenInputs=True)  # -> simplify(Result)
static_segmentations = StaticSegmentations()

# ----
# TODO:
# adapt to actual segments (not flat)
list_6 = ValueList({"Split to edge": 0, "Split to corner": 1}, selected="Split to edge")
project = Project(Geometry=a_segment, Plane=PlaneXY(0, 0, 0))  # -> Geometry, Transform
segment_subdivision_wip = SegmentSubdivisionWIP(shell=shell_7, model=analyze.CalculatedModel, proj_segments=project.Geometry, split_direction=list_6)  # disabled

# ----
# local optimisation of
# segment geometry
# as alternative to segment component
# 
# should in addition or be integrated
max_r = Slider(0.26, range=0..1)
genes_for_r = GenePool(
    Decimals=3,
    Maximum=1,
    Minimum=0,
    Value=[0.728, 0.278, 0.433, 0.626, 0.372, 0.386, 0.577, 0.602, 0.355, 0.402, 0.734, 0.343, 0.433, 0.4, 0.584, 0.602, 0.546, 0.339, 0.419, 0.149, 0.301, 0.008, 0.324, 0.386])
local_optimization = BooleanToggle(False)
genes_for_phi = GenePool(
    Decimals=3,
    Maximum=2,
    Minimum=0,
    Value=[0.427, 1.627, 0.784, 0.976, 1.468, 0.46, 1.011, 0.388, 0.825, 1.223, 1.146, 1.007, 0.773, 1.539, 1.505, 0.869, 0.424, 1.086, 1.514, 0.679, 1.331, 1.248, 1.135, 0.331])
entwine_2 = Entwine(Branch00=a_stresslines.StressLines1, Branch01=a_stresslines.StressLines2, FlattenInputs=True)  # disabled
get_projected_segments = GetProjectedSegments(
    shell=shell_7,
    stress_lines=entwine_2,
    maximum_deviation=max_r,
    local_optimization=local_optimization,
    phi_values=genes_for_phi,
    rho_values=genes_for_r)

# ---- group: 2nd chance to Kiwi analysis results...
shell_8 = Brep(shell_6)  # disabled
number_slider_10 = Slider(0.5, range=0..1)  # disabled
number_slider_11 = Slider(5, range=0..10)  # disabled
list_7 = ValueList({"STEEL": 1, "WOOD": 2, "GFRP": 3, "ETFE (Membrane)": 4, "CONCRETE": 5, "ALUMINIUM": 6}, selected="CONCRETE")  # disabled
panel_13 = Panel("0")  # disabled
panel_14 = Panel("1")  # disabled
list_8 = ValueList({"Displacements": 1, "Stresses": 2, "SupportForces": 3}, selected=["Displacements", "Stresses", "SupportForces"])  # disabled
dom²num = ConstructDomain²(UMin=panel_13, UMax=panel_14, VMin=panel_13, VMax=number_slider_10)  # disabled
shell_9 = Brep(shell_8)  # disabled
matdef_3 = MaterialDefaults(Type=list_7, IsNmm2=False, IskNcm2=False, IskNm2=True, mUnit=1)  # -> Material, YoungsModulus, AlphaT, Nue, Density, Strength; disabled
srfref_2 = SurfaceRefinement(
    PDeg=3,
    QDeg=3,
    ElementRefU=number_slider_11,
    ElementRefV=number_slider_11,
    IsKnotApproxElementSize=False,
    IsKnotSubdivision=True)  # disabled
subsrf = Isotrim(Surface=reparameterize(shell_9), Domain=dom²num)  # disabled
number_slider_12 = Slider(10, range=0..10)  # disabled
edges_5 = BrepEdges(Brep=shell_8)  # -> Naked, Interior, NonManifold; disabled
list_9 = ValueList({"DEAD": 1, "SNOW": 2, "PRES": 3, "PRES_FL": 4}, selected="DEAD")  # disabled
culln = CullNth(List=edges_5.Naked, CullFrequency=2)  # disabled
visopt = VisualizeOptions(
    ScaleCrossSections=1,
    ScaleSupports=1,
    ScaleLoads=1,
    ScaleCouplingPoints=1,
    ScaleConnectingPoints=1,
    ScaleRefinedControlPoints=1,
    ColourBeam=RGB(211, 211, 211),
    ColourCable=RGB(255, 255, 255),
    ColourSupports=RGB(232, 65, 119),
    ColourLoads=RGB(232, 65, 119),
    ColourConnects=RGB(255, 255, 255),
    ColourRefinedPatches=RGB(139, 0, 0),
    ColourSliding=RGB(135, 16, 55))  # disabled
supcrv_2 = SupportCurve(Crv=culln, DispX=True, DispY=True, DispZ=True, Rot=False)  # disabled
shell_10 = ShellElement(Brep=shell_8, Material=matdef_3.Material, Thickness=0.1, Refinement=srfref_2, HingeCoupling=False)  # disabled
srfload_2 = SurfaceLoad(Brep=shell_9, Loadtype=list_9, Direction=Vector(0, 0, -1), Value=number_slider_12, LoadCase=1)  # disabled
lina = LinearAnalysis(Name="MyAnalysis", OutputSetting=list_8)  # disabled
button_2 = Button()  # disabled
amodel_2 = AnalysisModel(
    Analysis=lina,
    StructuralElements=shell_10,
    Supports=supcrv_2,
    Loads=srfload_2,
    Visualizer=visopt,
    IntersectionTolerance=0.001,
    IsCarat=True,
    IsKratos=False,
    PenaltyFac=10000000,
    ShowCouplingIDs=False,
    ShowEdgeIDs=False,
    ShowGeo=True,
    ShowPatchIDs=True,
    ShowPrePro=True,
    ShowRef=False)  # disabled
list_10 = ValueList({"X Displacement": 1, "Y Displacement": 2, "Z Displacement": 3, "Displacement Length": 4, "P_N1": 5, "P_N2": 6, "N1": 7, "N2": 8, "N12": 9, "P_M1 (Shell)": 10, "P_M2 (Shell)": 11, "M1 (Shell)": 12, "M2 (Shell)": 13, "M12 (Shell)": 14, "von_Mises (Shell)": 15}, selected="P_M1 (Shell)")  # disabled
list_11 = ValueList({"X Displacement": 1, "Y Displacement": 2, "Z Displacement": 3, "Displacement Length": 4, "P_N1": 5, "P_N2": 6, "N1": 7, "N2": 8, "N12": 9, "P_M1 (Shell)": 10, "P_M2 (Shell)": 11, "M1 (Shell)": 12, "M2 (Shell)": 13, "M12 (Shell)": 14, "von_Mises (Shell)": 15}, selected="P_M2 (Shell)")  # disabled
number_slider_13 = Slider(0.1, range=0..0.1)  # disabled
list_12 = ValueList({"X Displacement": 1, "Y Displacement": 2, "Z Displacement": 3, "Displacement Length": 4, "P_N1": 5, "P_N2": 6, "N1": 7, "N2": 8, "N12": 9, "P_M1 (Shell)": 10, "P_M2 (Shell)": 11, "M1 (Shell)": 12, "M2 (Shell)": 13, "M12 (Shell)": 14, "von_Mises (Shell)": 15}, selected="P_M2 (Shell)")  # disabled
analysis_completed = IGASolver(AnalysisModel=amodel_2, Run=button_2, antiFreeze=False, showWindow=True)  # -> ResultModel, ErrorReport; disabled
_2dresults = _2DElementResults(Model=analysis_completed.ResultModel, Type=list_10, Scaling=number_slider_13)  # -> IDGP, V, R, LocationGP, ParameterLocationGP; disabled
_2dresults_2 = _2DElementResults(Model=analysis_completed.ResultModel, Type=list_11, Scaling=number_slider_13)  # -> IDGP, V, R, LocationGP, ParameterLocationGP; disabled
_2drescolplot = _2DElementResultColourPlot(Model=analysis_completed.ResultModel, Type=list_12, VisMeshCoarse=True, VisMeshSmooth=False)  # -> Model, Mesh, ValueDomain, LegendC, LegendT; disabled
_2dresiso = _2DElementResultIsolines(Model=analysis_completed.ResultModel, Type=list_12, ShowLevelNumbers=False)  # -> Isolines, Levels, LegendC, LegendT; disabled
lng_3 = ListLength(List=_2dresults.V)  # disabled
number_slider_14 = Slider(1000, range=0..1000)  # disabled
subtraction = Subtraction(A=lng_3, B=1)  # disabled
legend = Legend(Colour=_2drescolplot.LegendC, Tags=_2drescolplot.LegendT, LegendType=1)  # disabled
legend_2 = Legend(Colour=_2dresiso.LegendC, Tags=_2dresiso.LegendT, LegendType=1)  # disabled
geo_4 = Geometry(_2dresiso.Isolines)  # disabled
dom = ConstructDomain(DomainStart=0, DomainEnd=subtraction)  # disabled
random = Random(Range=dom, Number=number_slider_14, Seed=2)  # disabled
item_6 = ListItem(List=_2dresults.R, Index=random, Wrap=True)  # disabled
item_7 = ListItem(List=_2dresults_2.R, Index=random, Wrap=True)  # disabled

# ---- group: # segments
geo_5 = Geometry(get_projected_segments)
lng_4 = ListLength(List=geo_5)
bbox_2 = BoundingBox(Content=geo_5, Plane=PlaneXY(0, 0, 0), UnionBox=True)  # -> Box, Box_2
volume = Volume(Geometry=bbox_2.Box)  # -> Volume, Centroid
tag = TextTag(Location=volume.Centroid, Text=lng_4)

# ----
panel_15 = Panel("C:\Users\ec977\OneDrive - University of Bath\Eduardo\_DEVELOPMENT\__ PINBED SHELL\DSEdump\")
concat = Concatenate(FragmentA=panel_15, FragmentB="png\")
concat_2 = Concatenate(FragmentA=panel_15, FragmentB="csv\")
list_13 = ValueList({"eval": 0, "screenshots": 1, "both": 2, "neither": 3}, selected="both")
panel_16 = Panel(concat_2)

# ----
# PINBED
# SIMULATION
# merge FitBBox and FitMods?
# Slow due to surface split
number_slider_15 = Slider(2, range=0..10)
segments = Surface(simplify(graft(a_segment)))  # disabled
number_slider_16 = Slider(1, range=0..1)
a_fitbbox = FitBoundingBox(Segment=segments, AngularResolution=number_slider_15, Rotate3D=Toggle(False))
a_fitmods = FitPinbedModules(Box=flatten(a_fitbbox), Width=number_slider_16, Depth=number_slider_16, ToleranceLevel=Slider(3, range=0..10))  # -> simplify(ModuleRectangles)
a_areaeff = GetAreaEfficiency(Segment=segments, Modules=a_fitmods)
avr = Average(Input=flatten(a_areaeff))
a_simpinbed = SimulatePinbed(
    ShellSegments=segments,
    Modules=a_fitmods,
    VH=Toggle(False),
    SelectedSegments=Slider(4, range=0..10),
    MaximumPinLength=Slider(0.4, range=0..1))  # -> ShellSegments, ExtendedSegments, Modules, Boxes, PinAxes, PinHeights, PinColors
geo_6 = Geometry(a_simpinbed.Boxes)
geo_7 = Geometry(a_simpinbed.Modules)
geo_8 = Geometry(a_simpinbed.ExtendedSegments)
preview = CustomPreview(Geometry=a_simpinbed.PinAxes, Material=a_simpinbed.PinColors)
end = EndPoints(Curve=a_simpinbed.PinAxes)  # -> Start, End
lng_5 = ListLength(List=end.Start)
series_2 = Series(Start=0, Step=1, Count=lng_5)
tag_2 = TextTag(Location=end.Start, Text=series_2)

# ----
# Things that Capture
# does not capture
shell_11 = Brep(shell_6)
rec = DataRecorder(shell_11, DataLimit=-10, RecordData=True)

shells_from_dse = Data(rec)
cull_i_3 = CullIndex(List=shells_from_dse, Indices="-1", Wrap=True)
geo_9 = Geometry(a_simpinbed.ShellSegments)
item_8 = ListItem(List=cull_i_3, Index=Slider(3, range=0..15), Wrap=True)
galapagos = Galapagos(fitness=avr, gene=[genes_for_r, genes_for_phi])
female_worker = Geometry([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])
concrete = Geometry(female_worker)
preview_2 = CustomPreview(Geometry=concrete, Material=ColourSwatch(SwatchColor=RGB(207, 207, 207)))  # disabled

# ---- group: ACORN sampler
# difference from DSE:
# DSE subdivides slider domain into N subdomain and samples mid point;
# ACORN includes end points of sliders, subdivides into N-1 subdomains and samples all start points plus last endpoint
merge_5 = Merge(Data1=cable_prestress_2)  # disabled
c_script = CSharpScript()  # -> out, name, min, max; disabled
# ---------- c_script: C# ----------
    decimal _max, _min;
    System.Guid _name;


    IGH_Param tempPara = this.Component.Params.Input[0].Sources[0];
    //if (tempPara.GetType() == typeof(Grasshopper.Kernel.Special.GH_NumberSlider))
    //{
    Grasshopper.Kernel.Special.GH_NumberSlider NumSlider = tempPara as Grasshopper.Kernel.Special.GH_NumberSlider;
    _max = NumSlider.Slider.Maximum;
    _min = NumSlider.Slider.Minimum;
    _name = NumSlider.InstanceGuid;
    //}
    
    name = _name;
    min = _min;
    max = _max;
# ---------- end c_script ----------
readsliders = CSharpScript(S=merge_5)  # -> out, N, D; inputs S: list; disabled
# ---------- readsliders: C# ----------
    IGH_Param mergeOutputParam = this.Component.Params.Input[0].Sources[0];
    var mergeComp = mergeOutputParam.Attributes.GetTopLevel.DocObject as IGH_Component;
    var sliders = mergeComp.Params.Input;

    List<string> nicknames = new List<string>();
    List<Interval> domains = new List<Interval>();

    foreach (var slider in sliders)
    {
      var sliderSource = slider.Sources[0];
      nicknames.Add(sliderSource.NickName);

      Grasshopper.Kernel.Special.GH_NumberSlider NumSlider = sliderSource as Grasshopper.Kernel.Special.GH_NumberSlider;
      //var _max = NumSlider.Slider.Maximum;
      Interval sliderDomain = new Interval ((double) NumSlider.Slider.Minimum, (double) NumSlider.Slider.Maximum);
      //_min = NumSlider.Slider.Minimum;
      domains.Add(sliderDomain);
    }


    N = nicknames;
    D = domains;
# ---------- end readsliders ----------
number_slider_17 = Slider(5, range=1..10)  # disabled
number_slider_18 = Slider(5, range=1..10)  # disabled
number_slider_19 = Slider(5, range=1..12)  # disabled
item_9 = ListItem(List=readsliders.D, Index=0, Wrap=True)  # -> Item, Item1, Item2, Item3; disabled
range = Range(Domain=item_9.Item, Steps=number_slider_17)  # -> simplify(Range); disabled
range_2 = Range(Domain=item_9.Item1, Steps=number_slider_18)  # -> simplify(Range); disabled
range_3 = Range(Domain=item_9.Item2, Steps=number_slider_19)  # -> simplify(Range); disabled
parameter_labels = Text(readsliders.N)  # disabled

# ----
panel_17 = Panel(readsliders.out)  # disabled
range_4 = Range(Domain=item_9.Item3, Steps=number_slider_7)  # -> simplify(Range); disabled

# ---- group: ACORN sampler (continued)
crossref = CrossReference(ListC=range, ListA=range_2, ListB=range_3, ListD=range_4, CrossMode=1)  # -> ListC, ListA, ListB, ListD; disabled
entwine_3 = Entwine(Branch0X=crossref.ListC, Branch1X=crossref.ListA, Branch2X=crossref.ListB, Branch3X=crossref.ListD, FlattenInputs=False)  # -> simplify(Result); disabled
flip = FlipMatrix(Data=entwine_3)  # disabled
panel_18 = Panel(flip)  # disabled
design_map = Number(flip)  # disabled

# ---- group: for generating catalog (= Sift in DSE)
number_slider_20 = Slider(97, range=0..97)  # disabled
branch = TreeBranch(Tree=design_map, Path=number_slider_20, MaintainPaths=True)  # disabled

# ----
current_solution = Integer(number_slider_20)  # disabled
panel_19 = Panel(parameter_labels)  # disabled
item_10 = ListItem(List=branch, Index=0, Wrap=True)  # -> Item, Item1, Item2, Item3; disabled

# ----
# Analyse whole shell
number_slider_21 = Slider(0.2, range=0..1)
thickness_m_3 = Number(thickness_m)
srf_7 = Surface(shell_6)
mesh_breps_2 = MeshBrepsKaramba3D(
    Brep=srf_7,
    MeshResolution=Slider(0.1, range=0.01..1),
    EdgeRefinementFactor=number_slider_21,
    PointReduction=False,
    SmoothingStepSize=Slider(1, range=0..1),
    SmoothingIterations=Slider(3, range=0..10))  # -> Mesh, Info
mesh = Mesh(mesh_breps_2.Mesh)
load_pattern = Slider(2, range=1..7)
image_2 = ImageSampler(Filter="Colour", Interpolate=False, Umax=1, Umin=0, Vmax=1, Vmin=0, Wrap=1)
dead_load_kn_m2 = Slider(1, range=0..10)
live_load_kn_m2 = Slider(1.5, range=0..10)
load_pattern_2 = Integer(load_pattern)
matselect = MaterialSelectionKaramba3D(menu=[dropdown(3), dropdown(9)])
fixes_supp = BooleanToggle(False)
a_shellloads = ShellLoads(Mesh=mesh, DeadLoadValue=dead_load_kn_m2, LiveLoadValue=live_load_kn_m2, LiveLoadPattern=load_pattern_2)  # -> Loads, CheckPoints

# ---- group: variable thickness for Karamba
mesh_2 = Mesh(mesh)
Z_2 = UnitZ(Factor=1)
facen = FaceNormals(Mesh=mesh_2)  # -> graft(Centers), Normals
rev_2 = Reverse(Vector=Z_2)
project_2 = ProjectPoint(Point=facen.Centers, Direction=Z_2, Geometry=srf_4)  # -> simplify(Point), Index
project_3 = ProjectPoint(Point=facen.Centers, Direction=rev_2, Geometry=srf_6)  # -> simplify(Point), Index
dist = Distance(PointA=project_2.Point, PointB=project_3.Point)  # -> flatten(Distance)
bnd = Bounds(Numbers=dist)
panel_20 = Panel(bnd)

# ----
ln = Line(StartPoint=project_2.Point, EndPoint=project_3.Point)

thickness_m_4 = Number(dist)
thickness_m_5 = Number(thickness_m_4)
a_preliminaryshellanalysismodel_2 = PreliminaryShellAnalysisModel(
    ShellSurface=srf_7,
    Mesh=mesh,
    Thickness=thickness_m_5,
    Material=matselect,
    Loads=a_shellloads.Loads,
    FixedSupport=fixes_supp)
model = ModelKaramba3D(a_preliminaryshellanalysismodel_2)
a_results = AnalysisResults(KarambaModel=model, Percentile=Slider(99, range=90..100), FirstPrincipalStressOnly=Toggle(False))  # -> MaxComp, MaxComp_2, MaxCompMesh, MaxTens, MaxTens_2, MaxTensMesh, MaximumDisplacement, BucklingFactor, AnalysedModelThI, AnalysedModelThII
modelview = ModelViewKaramba3D(Model=a_results.AnalysedModelThI, ResultFactors=1, ResultCase=-1)  # -> Model, DeformedMesh, DeformedAxes, DeformedModel
merge_6 = Merge(
    Data1=a_results.MaxComp,
    Data2=a_results.MaxComp_2,
    Data3=a_results.MaxTens,
    Data4=a_results.MaxTens_2,
    Data5=a_results.BucklingFactor,
    Data6=a_results.MaximumDisplacement)
mesh_3 = Mesh(a_results.MaxCompMesh)
mesh_4 = Mesh(a_results.MaxTensMesh)
shellview = ShellViewKaramba3D(Model=modelview.Model, IndexOfLayer=0)  # -> Model, MeshesOfRenderedShells, LegendColors, LegendTags
medges = MeshEdges(Mesh=shellview.MeshesOfRenderedShells)  # -> NakedEdges, InteriorEdges, NonManifoldEdges
merge_7 = Merge(Data1=medges.NakedEdges, Data2=shellview.MeshesOfRenderedShells)
legend_3 = Legend(Colour=shellview.LegendColors, Tags=shellview.LegendTags, LegendType=1)
panel_21 = Panel(merge_6)
crv_3 = Curve(medges.NakedEdges)
geo_vizshell = Geometry(merge_7)

disassemble = DisassembleMaterialKaramba3D(Material=matselect)  # -> Material, TypeOfMaterial, FamilyNameOfMaterial, NameOfMaterial, ElemIdentifiers, Color, YoungsModulusKNCm2Dir12, InPlaneShearModulus_kN_cm2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
panel_22 = Panel(disassemble.YieldStrengthKNCm2Dir12)

# ---- group: illustration IASS2021
srf_8 = Surface(srf_7)  # disabled
number_slider_22 = Slider(1, range=0..10)  # disabled
project_4 = Project(Geometry=srf_8, Plane=PlaneXY(0, 0, 0))  # -> Geometry, Transform; disabled
number_slider_23 = Slider(4, range=0..10)  # disabled
modelview_2 = ModelViewKaramba3D(Model=a_results.AnalysedModelThI, ResultFactors=1, ResultCase=-1)  # -> Model, DeformedMesh, DeformedAxes, DeformedModel; disabled
Z_3 = UnitZ(Factor=number_slider_22)  # disabled
shellview_2 = ShellViewKaramba3D(Model=modelview_2.Model, IndexOfLayer=0)  # -> Model, MeshesOfRenderedShells, LegendColors, LegendTags; disabled
one_over_x = OneOverX(Value=number_slider_23)  # disabled
rev_3 = Reverse(Vector=Z_3)  # disabled
plan = Geometry(project_4.Geometry)  # disabled
sqgrid = Square(Plane=PlaneXY(0, 0, 0), Size=one_over_x, ExtentX=number_slider_23, ExtentY=number_slider_23)  # -> Cells, Points; disabled
move_3 = Move(Geometry=srf_8, Motion=rev_3)  # -> Geometry, Transform; disabled
move_4 = Move(Geometry=plan, Motion=rev_3)  # -> Geometry, Transform; disabled
geo_10 = Geometry(shellview_2.MeshesOfRenderedShells)  # disabled
surf = Geometry(move_3.Geometry)  # disabled
swatch = ColourSwatch(SwatchColor=RGB(255, 255, 255))  # disabled
medges_2 = MeshEdges(Mesh=geo_10)  # -> NakedEdges, InteriorEdges, NonManifoldEdges; disabled
join = JoinCurves(Curves=medges_2.NakedEdges, Preserve=False)  # disabled
preview_3 = CustomPreview(Geometry=medges_2.InteriorEdges, Material=swatch)  # disabled
iso = IsoCurve(Surface=reparameterize(surf), UVPoint=sqgrid.Points)  # -> UIsocurve, VIsocurve; disabled

# ----
wip_comploadsreactions = WIPCompLoadsReactions(model=a_results.AnalysedModelThI)  # disabled
item_11 = ListItem(List=merge_6, Index="1", Wrap=True)
capture = Capture(
    Variables=[membrane_prestress_u, cable_prestress_2, extra_thickness],
    Objectives=merge_6,
    Mode=list_13,
    Properties=0,
    DesignMap=sampler.DesignMap,
    CsvFilename="all-data",
    CsvDirectory=concat_2,
    ScreenshotFilename="design",
    ScreenshotDirectory=concat,
    BackupFrequency=0)  # -> DesignMapObjectives, CapturedProperties, Data, Images, Index
panel_23 = Panel(capture.Index)
panel_24 = Panel(capture.DesignMapObjectives)

# ----
# Analyse segmented shell
number_slider_24 = Slider(0.01, range=0..0.1)
segments_2 = Surface(graft(a_segment))
cables = Curve(entwine)  # disabled
segments_3 = Geometry(flatten(segments_2))
gap_size = Number(number_slider_24)
offset_surface_for_gap = OffsetSurfaceForGap(srf=segments_3, gap_size=gap_size)  # -> simplify(i)
cables_2 = BooleanToggle(False)
distance_between_connections = Slider(0.039, range=0..1)
segments_4 = Surface(segments_3)

wip_alternative_offset_meshing = WIPAlternativeOffsetMeshing(segments=segments_3, offset_segments=offset_surface_for_gap)

# ----
# if input cables disabled, split segments is same as input segments
cables_3 = Curve(cables)

embed_cables = EmbedCables(segments=offset_surface_for_gap, cables=cables_3)  # -> split_segments_2, split_cables_2
filter_2 = StreamFilter(Gate=cables_2, Stream0=offset_surface_for_gap, Stream1=embed_cables.split_segments_2)
split_cables = Geometry(embed_cables.split_cables_2)
mesh_segments = MeshSegments(offset_segments=filter_2, mesh_resolution=Slider(0.2, range=0..0.3))
segments_mesh = Mesh(mesh_segments)
make_springs = MakeSprings(conn_dist=distance_between_connections, segments=segments_4, segments_mesh=segments_mesh)
karamba = Karamba(springs=make_springs, mesh=segments_mesh)

# ---- group: PT in mesh for Karamba
curveclosestmeshvert = CurveClosestMeshVert(segments=segments_mesh, cables=split_cables, tol=Slider(0.01, range=0..0.1))  # -> simplify(polyline_2)
posttensioning = PostTensioning(pt_force=Slider(16.618, range=0..100), cables=curveclosestmeshvert)  # -> simplify(pt_intersection_nodes_3), vec_pt_force_4, vec_end_force_2

# ----
# Visualise building
shell_bottom_height = Slider(2.6, range=0..10)
shell_bottom_height_2 = Number(shell_bottom_height)
thickness_m_6 = Number(thickness_m)
segments_5 = Surface(a_segment)
Z_4 = UnitZ(Factor=shell_bottom_height_2)
move_5 = Move(Geometry=segments_5, Motion=Z_4)  # -> Geometry, Transform
flatten_floor = FlattenFloor(segments=move_5.Geometry)
fillet_edges = BooleanToggle(False)
column_height = Slider(3, range=0..10)  # disabled
column_radius = Slider(0.1, range=0..1)  # disabled
swatch_2 = ColourSwatch(SwatchColor=RGB(117, 117, 117))  # disabled
swatch_3 = ColourSwatch(SwatchColor=RGB(207, 207, 207))  # disabled

a_vizbldg = VisualiseBuilding(
    BayGeometry=bay_geometry,
    Segments=segments_5,
    Thickness=thickness_m_6,
    CornerRadius=number_slider_2,
    ColumnHeight=Slider(3.25, range=0..10),
    FilletEdges=Toggle(True))  # -> ThickSegments, Floor, Spacers, Columns, ColumnHeads, TieRods; disabled
thickness_2 = Number(thickness_m_6)
segments_6 = Surface(move_5.Geometry)
merge_8 = Merge(Data1=a_vizbldg.ThickSegments, Data2=a_vizbldg.Columns, Data3=a_vizbldg.ColumnHeads)
merge_9 = Merge(Data1=a_vizbldg.Floor, Data2=a_vizbldg.Spacers, Data3=a_vizbldg.TieRods)
Z_5 = UnitZ(Factor=thickness_2)  # disabled
fillet_edges_2 = Boolean(fillet_edges)  # disabled
concrete_2 = Geometry(merge_8)
steel = Geometry(merge_9)
extr = Extrude(Base=segments_6, Direction=Z_5)  # disabled
preview_4 = CustomPreview(Geometry=steel, Material=ColourSwatch(SwatchColor=RGB(117, 117, 117)))  # disabled
preview_5 = CustomPreview(Geometry=concrete_2, Material=ColourSwatch(SwatchColor=RGB(207, 207, 207)))  # disabled
brep_2 = Brep(extr)  # disabled
dispatch = Dispatch(List=brep_2, DispatchPattern=fillet_edges_2)  # -> ListA, ListB; disabled

# ---- group: enable for filleted edges
edges_6 = BrepEdges(Brep=brep_2)  # -> Naked, Interior, NonManifold; disabled
number_slider_25 = Slider(0.02, range=0..0.03)  # disabled
lng_6 = ListLength(List=edges_6.Interior)  # disabled
series_3 = Series(Start=0, Step=1, Count=lng_6)  # -> simplify(Series); disabled
filedge = FilletEdge(Shape=dispatch.ListA, Blend=0, Metric=0, Edges=series_3, Radii=number_slider_25)  # disabled

# ----
filter_3 = StreamFilter(Gate=fillet_edges_2, Stream0=brep_2, Stream1=filedge)  # disabled
bbox_3 = BoundingBox(Content=flatten(filter_3), Plane=PlaneXY(0, 0, 0), UnionBox=True)  # -> Box, Box_2; disabled
box_corners = BoxCorners(Box=bbox_3.Box)  # -> CornerA, CornerB, CornerC, CornerD, CornerE, CornerF, CornerG, CornerH; disabled
merge_10 = Merge(Data1=box_corners.CornerA, Data2=box_corners.CornerB, Data3=box_corners.CornerC, Data4=box_corners.CornerD)  # disabled
shell_segments = Brep(filter_3)  # disabled
corner_points = Point(merge_10)  # disabled

make_columns = MakeColumns(corner_points=corner_points, column_radius=column_radius, column_total_height=column_height)  # -> columns_2, column_tops_2; disabled
bracing = Bracing(columns=make_columns.columns_2)  # -> wall_diagonals_3, top_diagonals_3, top_edges_3; disabled
merge_11 = Merge(Data1=bracing.wall_diagonals_3, Data2=bracing.top_diagonals_3, Data3=bracing.top_edges_3)  # disabled
merge_12 = Merge(Data1=shell_segments, Data2=make_columns.columns_2, Data3=make_columns.column_tops_2)  # disabled
merge_13 = Merge(Data1=merge_11, Data2=flatten_floor)  # disabled
steel_2 = Geometry(merge_13)  # disabled
concrete_3 = Geometry(merge_12)  # disabled
preview_6 = CustomPreview(Geometry=steel_2, Material=swatch_2)  # disabled
preview_7 = CustomPreview(Geometry=concrete_3, Material=swatch_3)  # disabled

# ==== cluster GetProjectedSegments
maximum_deviation = ClusterInput()
local_optimization = ClusterInput()
stress_lines = ClusterInput()
rho_values = ClusterInput()
phi_values = ClusterInput()
shell = ClusterInput()
shell_2 = Brep(shell)
stress_lines_2 = Curve(stress_lines)
rho_values_2 = Number(rho_values)
maximum_deviation_2 = Number(maximum_deviation)
local_optimization_2 = Boolean(local_optimization)
phi_values_2 = Number(phi_values)
shell_3 = Brep(shell_2)
edges = BrepEdges(Brep=shell_3)  # -> Naked, Interior, NonManifold

# ---- group: [OBSOLETE] intersect and polygonize
bang = ExplodeTree(Data=stress_lines_2)  # -> Branch0, Branch1; disabled
edge_cables = Curve(bang.Branch1)  # disabled
corner_cables = Curve(bang.Branch0)  # disabled
ccx = CurveCurve(CurveA=simplify(graft(corner_cables)), CurveB=edge_cables)  # -> Points, ParamsA, ParamsB; disabled
ccx_2 = CurveCurve(CurveA=corner_cables, CurveB=simplify(graft(edge_cables)))  # -> Points, ParamsA, ParamsB; disabled
trim = TrimTree(Tree=ccx.Points, Depth=1)  # disabled
trim_2 = TrimTree(Tree=ccx_2.Points, Depth=1)  # disabled
alongcrv = SortAlongCurve(Points=trim, Curve=graft(corner_cables))  # -> Points, Indices; disabled
alongcrv_2 = SortAlongCurve(Points=trim_2, Curve=graft(edge_cables))  # -> Points, Indices; disabled
pline = PolyLine(Vertices=alongcrv.Points, Closed=False)  # disabled
pline_2 = PolyLine(Vertices=alongcrv_2.Points, Closed=False)  # disabled
merge = Merge(Data1=pline, Data2=pline_2)  # -> simplify(Result); disabled
trim_3 = TrimTree(Tree=merge, Depth=1)  # disabled
poly_cables = Curve(flatten(trim_3))  # disabled

# ----
project = Project(Geometry=edges.Naked, Plane=PlaneXY(0, 0, 0))  # -> Geometry, Transform
join = JoinCurves(Curves=project.Geometry, Preserve=False)
intersect_stress_lines = IntersectStressLines(stress_lines=stress_lines_2)
surface_plan = Curve(join)
jiggle_points = JigglePoints(
    intersection_points=intersect_stress_lines,
    maximum_deviation=maximum_deviation_2,
    phi_values=phi_values_2,
    rho_values=rho_values_2,
    curves_to_snap=surface_plan)
intersection_points = Point(intersect_stress_lines)
local_optimization_3 = Boolean(local_optimization_2)
jiggled_points = Point(jiggle_points)
filter = StreamFilter(Gate=local_optimization_3, Stream0=intersection_points, Stream1=jiggled_points)
make_segments = MakeSegments(stress_lines=stress_lines_2, intersection_points=filter, tolerance=maximum_deviation_2)
make_keystone = MakeKeystone(surface_plan=surface_plan, intersection_points=filter)
merge_2 = Merge(Data1=make_keystone, Data2=make_segments)  # -> flatten(Result)
brep = Brep(surface_plan)
srfsplit = SurfaceSplit(Surface=brep, Curves=merge_2)
straight_proj_segments = Surface(srfsplit)
straight_proj_segments_2 = ClusterOutput(straight_proj_segments)

# ==== cluster StaticSegmentations
manualopt02_1_4 = Curve([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])
manualopt01 = Curve([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])
xz = XZPlane(Origin=Point(0, 0, 0))
crv = Curve(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)
_6x6_segments = Surface([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])
lor_segments = Surface([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])
geo = Geometry(manualopt02_1_4)
mirror = Mirror(Geometry=geo, Plane=xz)  # -> Geometry, Transform
edges = BrepEdges(Brep=lor_segments)  # -> Naked, Interior, NonManifold
merge = Merge(Data1=geo, Data2=mirror.Geometry)
yz = YZPlane(Origin=Point(0, 0, 0))
join = JoinCurves(Curves=edges.Naked, Preserve=False)
mirror_2 = Mirror(Geometry=merge, Plane=yz)  # -> Geometry, Transform
merge_2 = Merge(Data1=merge, Data2=mirror_2.Geometry, Data3=crv)
boundary = BoundarySurfaces(Edges=merge_2)
segments = Surface(_6x6_segments)
segments_2 = ClusterOutput(segments)

# ==== cluster SegmentSubdivisionWIP
split_direction = ClusterInput()
proj_segments = ClusterInput()
shell = ClusterInput()
model = ClusterInput()
shell_2 = Surface(shell)
model_2 = ModelKaramba3D(model)
split_direction_2 = Integer(split_direction)
proj_segments_2 = Surface(proj_segments)
split_to_corner = Slider(0.646, range=0..1)  # disabled
split_to_edge = Slider(0.5, range=0..1)
num = Number(split_to_corner)
merge = Merge(Data1="0", Data2=num, Data3="1")

srf = Surface(proj_segments_2)
bbox = BoundingBox(Content=srf, Plane=PlaneXY(0, 0, 0), UnionBox=True)  # -> Box, Box_2
area = Area(Geometry=bbox.Box)  # -> Area, Centroid
box_corners = BoxCorners(Box=bbox.Box)  # -> CornerA, CornerB, CornerC, CornerD, CornerE, CornerF, CornerG, CornerH
panel = Panel("exclude keystone + cornerstones")
merge_2 = Merge(Data1=box_corners.CornerA, Data2=box_corners.CornerB, Data3=box_corners.CornerC, Data4=box_corners.CornerD)
area_2 = Area(Geometry=srf)  # -> Area, Centroid; disabled
merge_3 = Merge(Data1=area.Centroid, Data2=merge_2)

debrep = DeconstructBrep(Brep=srf)  # -> Faces, Edges, simplify(Vertices)
join = JoinCurves(Curves=debrep.Edges, Preserve=False)  # -> simplify(Curves)
area_3 = Area(Geometry=join)  # -> Area, flatten(Centroid)

cp = ClosestPoint(Point=merge_3, Cloud=area_3.Centroid)  # -> ClosestPoint, CPIndex, Distance
cull_i = CullIndex(List=srf, Indices=cp.CPIndex, Wrap=True)

item = ListItem(List=cull_i, Index=Slider(7, range=0..10), Wrap=True)

# ----
# rebuild segment surfaces with appropriate UV space
srf_2 = Surface(simplify(graft(cull_i)))
crv = Curve(srf_2)
bbox_2 = BoundingBox(Content=flatten(crv), Plane=PlaneXY(0, 0, 0), UnionBox=True)  # -> Box, Box_2
area_4 = Area(Geometry=crv)  # -> Area, Centroid
volume = Volume(Geometry=bbox_2.Box)  # -> Volume, Centroid
vec2pt = Vector2Pt(PointA=area_4.Centroid, PointB=volume.Centroid, Unitize=False)  # -> Vector, Length
loft_opt = LoftOptions(Closed=False, Adjust=Toggle(True), Rebuild=0, Refit=0, Type=0)

simplify = SimplifyCurve(Curve=crv)  # -> Curve, Simplified

# ---- group: to which support should each segment look at
# get support points
# (temporary, only works for rectangles)
# determine edge closest to support
srf_3 = Surface(srf_2)
bbox_3 = BoundingBox(Content=flatten(srf_3), Plane=PlaneXY(0, 0, 0), UnionBox=True)  # -> Box, Box_2
box_corners_2 = BoxCorners(Box=bbox_3.Box)  # -> CornerA, CornerB, CornerC, CornerD, CornerE, CornerF, CornerG, CornerH
merge_4 = Merge(Data1=box_corners_2.CornerA, Data2=box_corners_2.CornerB, Data3=box_corners_2.CornerC, Data4=box_corners_2.CornerD)
area_5 = Area(Geometry=srf_3)  # -> Area, Centroid; disabled

# ----
debrep_2 = DeconstructBrep(Brep=srf_3)  # -> Faces, Edges, simplify(Vertices)
join_2 = JoinCurves(Curves=debrep_2.Edges, Preserve=False)  # -> simplify(Curves)
area_6 = Area(Geometry=join_2)  # -> Area, Centroid

# ---- group: to which support should each segment look at (continued)
cp_2 = ClosestPoint(Point=area_6.Centroid, Cloud=merge_4)  # -> ClosestPoint, CPIndex, Distance

# ----
vec2pt_2 = Vector2Pt(PointA=area_4.Centroid, PointB=cp_2.ClosestPoint, Unitize=False)  # -> Vector, Length
explode = Explode(Curve=simplify.Curve, Recursive=True)  # -> simplify(Segments), simplify(Vertices)
pl = ConstructPlane(Origin=area_4.Centroid, XAxis=vec2pt_2.Vector, YAxis=vec2pt.Vector)
cull_i_2 = CullIndex(List=explode.Vertices, Indices="0", Wrap=True)
cir = Circle(Plane=pl, Radius="0.2")
alongcrv = SortAlongCurve(Points=cull_i_2, Curve=cir)  # -> Points, Indices
item_2 = ListItem(List=alongcrv.Points, Index=0, Wrap=True)  # -> Item, Item1, Item2, Item3
ln = Line(StartPoint=item_2.Item3, EndPoint=item_2.Item2)
ln_2 = Line(StartPoint=item_2.Item, EndPoint=item_2.Item1)
merge_5 = Merge(Data1=ln_2, Data2=ln)  # -> simplify(Result)
loft = Loft(Curves=merge_5, Options=loft_opt)

# ---- group: number points in closed polyline
pt = Point(simplify(alongcrv.Points))
pline = PolyLine(Vertices=pt, Closed="True")
area_7 = Area(Geometry=pline)  # -> Area, simplify(Centroid)
vec2pt_3 = Vector2Pt(PointA=pt, PointB=area_7.Centroid, Unitize="True")  # -> Vector, Length
lng = ListLength(List=pt)
multiplication = Multiplication(A=vec2pt_3.Vector, B=Slider(0.312, range=0..1))
move = Move(Geometry=pt, Motion=multiplication)  # -> Geometry, Transform
series = Series(Start=0, Step=1, Count=lng)
tag = TextTag(Location=move.Geometry, Text=series)

# ---- group: split using PSlines
md_slider = MDSlider(SliderMode=0, slider_value=Point(0.5, 0.5, 0.5), x_domain=Domain(0, 1), y_domain=Domain(0, 1), z_domain=Domain(0, 1))
srf_4 = Surface(loft)
evalsrf = EvaluateSurface(Surface=reparameterize(srf_4), Point=md_slider)  # -> Point, Normal, UDirection, VDirection, Frame
Z = UnitZ(Factor=1)
shell_3 = Surface(shell_2)
project = ProjectPoint(Point=evalsrf.Point, Direction=Z, Geometry=shell_3)  # -> Point, Index
model_3 = ModelKaramba3D(model_2)
shelllineresults = LineResultsOnShellsKaramba3D(
    AnalyzedModel=model_3,
    LayerPosition=Slider(0, range=-1..1),
    ListOfSourcesOfPrincipalStressLinesLinesPoints=project.Point,
    SegmentLength_m=0.5,
    DA_deg=5,
    mode="PrincStress")  # -> AnalyzedModel, Lines1, Lines2
crv_2 = Curve(shelllineresults.Lines2)
crv_3 = Curve(shelllineresults.Lines1)
trim = TrimTree(Tree=simplify(crv_3), Depth=1)
trim_2 = TrimTree(Tree=simplify(crv_2), Depth=1)
join_3 = JoinCurves(Curves=trim, Preserve=False)
join_4 = JoinCurves(Curves=trim_2, Preserve=False)
project_2 = Project(Geometry=join_3, Plane=PlaneXY(0, 0, 0))  # -> simplify(Geometry), Transform
project_3 = Project(Geometry=join_4, Plane=PlaneXY(0, 0, 0))  # -> simplify(Geometry), Transform
split_direction_3 = Integer(split_direction_2)
merge_6 = Merge(Data1=project_2.Geometry, Data2=project_3.Geometry)
crv_4 = Curve(srf_4)
item_3 = ListItem(List=merge_6, Index=split_direction_3, Wrap=True)
ccx = CurveCurve(CurveA=crv_4, CurveB=item_3)  # -> Points, ParamsA, ParamsB
toggle = BooleanToggle(False)
pline_2 = PolyLine(Vertices=ccx.Points, Closed=False)
srfsplit = SurfaceSplit(Surface=srf_4, Curves=pline_2)

# ---- group: split to edge
srf_5 = Surface(loft)
divide = DivideDomain²(Domain=srf_5, UCount=Slider(1, range=1..2), VCount=Slider(2, range=1..2))
subsrf = Isotrim(Surface=srf_5, Domain=divide)

# ----
split_segments = Geometry(simplify(srfsplit))
split_segments_2 = ClusterOutput(split_segments)

# ---- group: split to both
num_2 = Number(split_to_edge)
srf_6 = Surface(loft)
merge_7 = Merge(Data1="0", Data2=num_2, Data3="1")
panel_2 = Panel("False")
consec = ConsecutiveDomains(Numbers=merge_7, Additive=panel_2)

# ----
consec_2 = ConsecutiveDomains(Numbers=merge, Additive=panel_2)
crossref = CrossReference(ListA=consec, ListB=consec_2, CrossMode=1)  # -> ListA, ListB

# ---- group: split to both (continued)
dom² = ConstructDomain²(DomainU=crossref.ListA, DomainV=crossref.ListB)
subsrf_2 = Isotrim(Surface=reparameterize(srf_6), Domain=dom²)

# ==== cluster FlattenFloor
segments = ClusterInput()

# ---- group: generate fl
segments_2 = Surface(segments)
item = ListItem(List=flatten(segments_2), Index=0, Wrap=True)
bbox = BoundingBox(Content=flatten(segments_2), Plane=PlaneXY(0, 0, 0), UnionBox=True)  # -> Box, Box_2
untrim = Untrim(Surface=item)
box = EvaluateBox(Box=bbox.Box, UParameter=0.5, VParameter=0.5, WParameter="1")  # -> Plane, Point, Include
sec = BrepPlane(Brep=bbox.Box, Plane=box.Plane)  # -> Curves, Points
neg = Negative(Value=Slider(0.442, range=0..1))
offset = OffsetCurve(Curve=sec.Curves, Distance=neg, Plane=PlaneXY(0, 0, 0), Corners=1)
Z = UnitZ(Factor=Slider(0.05, range=0..0.1))
boundary = BoundarySurfaces(Edges=sec.Curves)
boundary_2 = BoundarySurfaces(Edges=offset)
sdivide = DivideSurface(Surface=boundary_2, UCount=10, VCount=10)  # -> simplify(graft(Points)), Normals, Parameters
extr = Extrude(Base=boundary, Direction=Z)
project = ProjectPoint(Point=sdivide.Points, Direction=Vector(0, 0, -1), Geometry=untrim)  # -> Point, Index
number_slider = Slider(0.03, range=0..0.1)
merge = Merge(Data1=sdivide.Points, Data2=project.Point)
neg_2 = Negative(Value=number_slider)
pline = PolyLine(Vertices=merge, Closed=False)
ext = ExtendCurve(Curve=pline, Type=0, Start="0", End=neg_2)
pipe = Pipe(Curve=ext, Radius=number_slider, Caps=0)
merge_2 = Merge(Data1=extr, Data2=pipe)
flat_floor = Geometry(merge_2)

# ----
flat_floor_2 = ClusterOutput(flat_floor)

# ==== cluster Bracing
columns = ClusterInput()
columns_2 = Brep(columns)
bbox = BoundingBox(Content=columns_2, Plane=PlaneXY(0, 0, 0))  # -> Box, Box_2
boxsize = BoxSize(box=bbox.Box)  # -> X_2, Y_2, Z_2, A_2, V_2
brace_offset = Slider(0.15, range=0..0.2)
shell_bottom_height = Number(boxsize.Z_2)
subtraction = Subtraction(A=shell_bottom_height, B=brace_offset)
box = EvaluateBox(Box=bbox.Box, UParameter=0.5, VParameter=0.5, WParameter="0")  # -> Plane, Point, Include
Z = UnitZ(Factor=subtraction)
Z_2 = UnitZ(Factor=brace_offset)
pt = Point(box.Point)
move = Move(Geometry=pt, Motion=Z)  # -> Geometry, Transform
move_2 = Move(Geometry=pt, Motion=Z_2)  # -> Geometry, Transform
merge = Merge(Data1=move_2.Geometry, Data2=move.Geometry)
bbox_2 = BoundingBox(Content=merge, Plane=PlaneXY(0, 0, 0), UnionBox=True)  # -> Box, Box_2
pline = PolyLine(Vertices=move.Geometry, Closed=True)
box_corners = BoxCorners(Box=bbox_2.Box)  # -> CornerA, CornerB, CornerC, CornerD, CornerE, CornerF, CornerG, CornerH
box_corners_2 = BoxCorners(Box=bbox_2.Box)  # -> CornerA, CornerB, CornerC, CornerD, CornerE, CornerF, CornerG, CornerH
explode = Explode(Curve=pline, Recursive=True)  # -> Segments, Vertices
ln = Line(StartPoint=box_corners.CornerF, EndPoint=box_corners.CornerH)
ln_2 = Line(StartPoint=box_corners.CornerE, EndPoint=box_corners.CornerG)
ln_3 = Line(StartPoint=box_corners_2.CornerC, EndPoint=box_corners_2.CornerF)
ln_4 = Line(StartPoint=box_corners_2.CornerB, EndPoint=box_corners_2.CornerG)
ln_5 = Line(StartPoint=box_corners_2.CornerC, EndPoint=box_corners_2.CornerH)
ln_6 = Line(StartPoint=box_corners_2.CornerD, EndPoint=box_corners_2.CornerG)
merge_2 = Merge(Data1=ln_3, Data2=ln_4, Data3=ln_5, Data4=ln_6)
merge_3 = Merge(Data1=ln_2, Data2=ln)
top_edges = Geometry(explode.Segments)
wall_diagonals = Geometry(merge_2)
top_diagonals = Geometry(merge_3)
entwine = Entwine(Branch00=wall_diagonals, Branch01=top_diagonals, Branch02=top_edges, FlattenInputs=True)  # -> simplify(graft(Result))
merge_4 = Merge(Data1=wall_diagonals, Data2=top_diagonals, Data3=top_edges)  # -> flatten(Result)
number_slider = Slider(0.02, range=0..0.1)
crv = Curve(merge_4)
bcx = BrepCurve(Brep=flatten(columns_2), Curve=entwine)  # -> Curves, Points
pipe = Pipe(Curve=entwine, Radius=number_slider, Caps=0)  # -> simplify(Pipe)
multiplication = Multiplication(A=number_slider, B=Slider(1.3, range=1..2))
sph = Sphere(Base=bcx.Points, Radius=multiplication)  # -> simplify(Sphere)
trim = TrimTree(Tree=pipe, Depth=1)
trim_2 = TrimTree(Tree=sph, Depth="2")
bang = ExplodeTree(Data=trim)  # -> Branch0, Branch1, Branch2
bang_2 = ExplodeTree(Data=trim_2)  # -> Branch0, Branch1, Branch2
wall_diagonals_2 = Geometry([bang.Branch0, bang_2.Branch0])
top_diagonals_2 = Geometry([bang.Branch1, bang_2.Branch1])
top_edges_2 = Geometry([bang.Branch2, bang_2.Branch2])
top_diagonals_3 = ClusterOutput(top_diagonals_2)
wall_diagonals_3 = ClusterOutput(wall_diagonals_2)
top_edges_3 = ClusterOutput(top_edges_2)

# ==== cluster MakeColumns
corner_points = ClusterInput()
column_radius = ClusterInput()
column_total_height = ClusterInput()
corner_points_2 = Point(corner_points)
corner_points_3 = Point(corner_points_2)
column_radius_2 = Number(column_radius)
project = Project(Geometry=corner_points_3, Plane=PlaneXY(0, 0, 0))  # -> Geometry, Transform
column_total_height_2 = Number(column_total_height)
dist = Distance(PointA=simplify(graft(corner_points_3)), PointB=simplify(graft(project.Geometry)))  # -> flatten(Distance)
subtraction = Subtraction(A=column_total_height_2, B=dist)
column_height = Number(dist)
column_bottom = Point(project.Geometry)
column_top_height = Number(subtraction)
column_radius_3 = Number(column_radius_2)
Z = UnitZ(Factor=column_height)
multiplication = Multiplication(A=column_radius_3, B=Slider(2.3, range=0..10))
multiplication_2 = Multiplication(A=column_radius_3, B=Slider(4.4, range=0..10))
move = Move(Geometry=column_bottom, Motion=Z)  # -> Geometry, Transform
neg = Negative(Value=multiplication_2)
cyl = Cylinder(Base=column_bottom, Radius=column_radius_2, Length=column_height)
cyl_2 = Cylinder(Base=move.Geometry, Radius=column_radius_2, Length=column_top_height)
cone = Cone(Base=corner_points_2, Radius=multiplication, Length=neg)  # -> Cone, Tip
cyl_3 = Cylinder(Base=corner_points_2, Radius=Slider(0.2, range=0..1), Length=Slider(0.08, range=0..0.1))
cap = CapHoles(Brep=cone.Cone)
cap_2 = CapHoles(Brep=cyl_3)
cap_3 = CapHoles(Brep=cyl)
cap_4 = CapHoles(Brep=cyl_2)
merge = Merge(Data1=cap_2, Data2=cap, Data3=cap_3)
sunion = SolidUnion(Breps=merge)
column_tops = Brep(cap_4)
columns = Brep(sunion)
columns_2 = ClusterOutput(columns)
column_tops_2 = ClusterOutput(column_tops)

# ==== cluster OffsetSurfaceForGap
srf = ClusterInput()
test_surface = TestSurface()
gap_size = ClusterInput()
srf_2 = Surface(simplify(graft(srf)))
gap_size_2 = Number(gap_size)
division = Division(A=gap_size_2, B=2)
edges = BrepEdges(Brep=srf_2)  # -> simplify(Naked), Interior, NonManifold
neg = Negative(Value=division)
merge = Merge(Data1=division, Data2=neg)
c_offsetonsurf = CSharpScript(S=srf_2, G=gap_size_2)  # -> out, A; inputs S: tree of Brep, G: Double
# ---------- c_offsetonsurf: C# ----------
    double tol = Rhino.RhinoDoc.ActiveDoc.ModelAbsoluteTolerance;
    DataTree<Brep> surfaces = S;
    double gapSize = G;
    DataTree<Brep> offsetSegments = new DataTree<Brep>();
    DataTree<Curve> offsetEdges = new DataTree<Curve>();
    foreach (GH_Path path in surfaces.Paths)
    {
      //Brep offsetSegment = null;
      BrepFace surface = surfaces.Branch(path)[0].Faces[0];
      // try offset on surface for both directions (inwards and outwards), use the one that is not null (is on surface)
      List<Curve> offsetSurfEdges = new List<Curve>();
      foreach (Curve edge in surface.Brep.Edges)
      {
        Curve offsetEdge = null;
        Curve[] offsetEdgeArray = edge.OffsetOnSurface(surface, gapSize / 2, tol);
        Print(offsetEdgeArray.Length.ToString());
        if (offsetEdgeArray != null)
          offsetEdge = offsetEdgeArray[0];
        else
        {
          offsetEdgeArray = edge.OffsetOnSurface(surface, -gapSize / 2, tol);
          if (offsetEdgeArray != null)
            offsetEdge = offsetEdgeArray[0];
          else
            offsetEdge = edge;
        }
        offsetSurfEdges.Add(offsetEdge);
      }


      offsetEdges.AddRange(offsetSurfEdges, path);
    }
    A = offsetEdges;
# ---------- end c_offsetonsurf ----------
offsets = OffsetOnSrf(Curve=edges.Naked, Distance=neg, Surface=srf_2)
offsets_2 = OffsetOnSrf(Curve=edges.Naked, Distance=division, Surface=srf_2)
merge_2 = Merge(Data1=offsets, Data2=offsets_2)
srf_3 = Surface(simplify(graft(srf_2)))
trim = TrimTree(Tree=merge_2, Depth=1)
edges_2 = BrepEdges(Brep=srf_3)  # -> Naked, Interior, NonManifold
join = JoinCurves(Curves=edges_2.Naked, Preserve=False)
srfsplit = SurfaceSplit(Surface=srf_2, Curves=trim)
area = Area(Geometry=srf_3)  # -> Area, Centroid
project = Project(Geometry=join, Plane=PlaneXY(0, 0, 0))  # -> Geometry, Transform
area_2 = Area(Geometry=srfsplit)  # -> Area, Centroid
midpt = CurveMiddle(Curve=edges_2.Naked)
offset = OffsetCurve(Curve=project.Geometry, Distance=division, Plane=PlaneXY(0, 0, 0), Corners=1)
sort = SortList(Keys=area_2.Area, ValuesA=srfsplit)  # -> Keys, ValuesA
geodesic = Geodesic(Surface=srf_3, Start=midpt, End=area.Centroid)
item = ListItem(List=reverse(sort.ValuesA), Index=0, Wrap=True)
i = ClusterOutput(item)

# ==== cluster MakeSprings
segments_mesh = ClusterInput()
segments = ClusterInput()
segments_2 = Surface(segments)
segments_mesh_2 = Mesh(flatten(segments_mesh))

# ---- group: determine internal edges + topology
join = BrepJoin(Breps=segments_2)  # -> Breps, Closed
debrep = DeconstructBrep(Brep=join.Breps)  # -> Faces, Edges, Vertices
topology = BrepTopology(Brep=join.Breps, PerspectiveOnly=False)  # -> FaceFaceAdjacency, FaceEdgeAdjacency, simplify(EdgeFaceAdjacency)
lng = ListLength(List=topology.EdgeFaceAdjacency)
larger = LargerThan(FirstNumber=lng, SecondNumber="2")  # -> LargerThan, OrEqualTo
dispatch = Dispatch(List=topology.EdgeFaceAdjacency, DispatchPattern=larger.OrEqualTo)  # -> ListA, ListB
clean = CleanTree(RemoveNulls=True, RemoveInvalid=True, RemoveEmpty=Toggle(True), Tree=dispatch.ListA)
tstat = TreeStatistics(Tree=clean)  # -> Paths, Length, Count
dpath = DeconstructPath(Branch=tstat.Paths)
item = ListItem(List=debrep.Edges, Index=flatten(dpath), Wrap=True)
match = MatchTree(Tree=graft(item), Guide=clean)
adjacent_faces = Integer(clean)
internal_edges = Curve(match)

# ---- group: determine gap size
segments_mesh_3 = Mesh(graft(segments_mesh_2))
segments_3 = Surface(graft(segments_2))
medges = MeshEdges(Mesh=segments_mesh_3)  # -> NakedEdges, InteriorEdges, NonManifoldEdges
debrep_2 = DeconstructBrep(Brep=segments_3)  # -> Faces, Edges, Vertices
join_2 = JoinCurves(Curves=medges.NakedEdges, Preserve=False)  # -> simplify(Curves)
join_3 = JoinCurves(Curves=debrep_2.Edges, Preserve=False)  # -> simplify(Curves)
explode = Explode(Curve=join_2, Recursive=True)  # -> Segments, Vertices
pt = Point(explode.Vertices)
crv_cp = CurveClosestPoint(Point=pt, Curve=join_3)  # -> Point, Parameter, Distance
sort = SortList(Keys=crv_cp.Distance)  # -> Keys, ValuesA
item_2 = ListItem(List=sort.Keys, Index=0, Wrap=True)
avr = Average(Input=flatten(item_2))
multiplication = Multiplication(A=avr, B=2)
gap_size = Number(multiplication)

# ----
gap_size_2 = Number(gap_size)

# ---- group: mesh vertices on curves
item_3 = ListItem(List=segments_mesh_2, Index=adjacent_faces, Wrap=True)
crv = Curve(internal_edges)
demesh = DeconstructMesh(Mesh=item_3)  # -> Vertices, Faces, Colours, Normals
repeat = RepeatData(Data=crv, Length="2")  # -> simplify(graft(Data))
pull = PullPoint(Point=demesh.Vertices, Geometry=repeat, ClosestOnly=True)  # -> ClosestPoint, Distance
smaller = SmallerThan(FirstNumber=pull.Distance, SecondNumber=gap_size_2)  # -> SmallerThan, OrEqualTo
cull = CullPattern(List=demesh.Vertices, CullPattern=smaller.SmallerThan)  # -> simplify(List)
alongcrv = SortAlongCurve(Points=cull, Curve=repeat)  # -> simplify(Points), Indices

# ----
number_slider = Slider(0.221, range=0..3)
conn_dist = ClusterInput()
conn_dist_2 = Number(conn_dist)

# ---- group: select points according to connection distance (approx.)
shatter = Shatter(Curve=reparameterize(repeat), Parameters=".5")  # -> simplify(Segments)
item_4 = ListItem(List=shatter, Index=0, Wrap=True)  # -> Item, Item1
flip = FlipCurve(Curve=item_4.Item)  # -> Curve, Flag
merge = Merge(Data1=flip.Curve, Data2=item_4.Item1)
divlength = DivideLength(Curve=merge, Length=conn_dist_2)  # -> simplify(Points), Tangents, Parameters
trim = TrimTree(Tree=divlength.Points, Depth=1)
rdpoints = RemoveDuplicatePointsKaramba3D(Point=trim, LimitDistance=0.005)  # -> OutPoint, Info, Indexes

# ----
cp = ClosestPoint(Point=rdpoints.OutPoint, Cloud=alongcrv.Points)  # -> ClosestPoint, CPIndex, Distance
rdpoints_2 = RemoveDuplicatePointsKaramba3D(Point=cp.ClosestPoint, LimitDistance=0.005)  # -> OutPoint, Info, Indexes
pt_2 = Point(simplify(graft(rdpoints_2.OutPoint)))
path_mapper = PathMapper(pt_2, source="{A;B;C}", target="{A;C;B}")
pt_3 = Point(path_mapper)
trim_2 = TrimTree(Tree=pt_3, Depth=1)
item_5 = ListItem(List=trim_2, Index=0, Wrap=True)  # -> Item, Item1
ln = Line(StartPoint=item_5.Item, EndPoint=item_5.Item1)
springs = Line(ln)
springs_2 = ClusterOutput(springs)
spring_angles = SpringAngles(crv=springs)

# ==== cluster CurveClosestMeshVert
number_slider = Slider(8, range=0..100)
segments = ClusterInput()
cables = ClusterInput()
tol = ClusterInput()
tol_2 = Number(tol)
segments_2 = Mesh(segments)
number_slider_2 = Slider(0.01, range=0..0.01)
cables_2 = Curve(cables)
branch = TreeBranch(Tree=segments_2, Path=number_slider, MaintainPaths=True)
branch_2 = TreeBranch(Tree=cables_2, Path=number_slider, MaintainPaths=True)
mesh = Mesh(segments_2)
curve = Curve(cables_2)

# ---- group: exclude segments without cables
tstat = TreeStatistics(Tree=cables_2)  # -> Paths, Length, Count
branch_3 = TreeBranch(Tree=mesh, Path=tstat.Paths, MaintainPaths=True)

# ----
deconstruct_mesh = DeconstructMesh(Mesh=branch_3)  # -> simplify(Vertices), Faces, Colours, Normals

# ---- group: "manual" cross reference
group = Group(Objects=deconstruct_mesh.Vertices)
lng = ListLength(List=curve)
repeat = RepeatData(Data=group, Length=lng)  # -> simplify(Data)
ungroup = Ungroup(Group=repeat)

# ----
curve_2 = Curve(graft(curve))
pull = PullPoint(Point=ungroup, Geometry=curve_2, ClosestOnly=True)  # -> ClosestPoint, Distance
smaller = SmallerThan(FirstNumber=pull.Distance, SecondNumber=tol_2)  # -> SmallerThan, OrEqualTo
dispatch = Dispatch(List=pull.ClosestPoint, DispatchPattern=smaller.SmallerThan)  # -> ListA, ListB
pt = Point(dispatch.ListA)
sort_along_curve = SortAlongCurve(Points=pt, Curve=curve_2)  # -> simplify(Points), Indices
cullpt = CullDuplicates(Points=sort_along_curve.Points, Tolerance=tol_2, CullMode=3)  # -> Points, Indices, Valence
polyline = PolyLine(Vertices=cullpt.Points, Closed=False)
polyline_2 = ClusterOutput(polyline)

# ==== cluster PostTensioning
cables = ClusterInput()
pt_force = ClusterInput()
cables_2 = Geometry(cables)
pt_force_2 = Number(pt_force)

# ----
# PT forces
pt_kn = Number(pt_force_2)
crv = Curve(cables_2)
flip = FlipCurve(Curve=crv)  # -> Curve, Flag
explode = Explode(Curve=crv, Recursive=True)  # -> Segments, simplify(Vertices)
crv_2 = Curve(crv)
lng = ListLength(List=explode.Vertices)
series = Series(Start=0, Step=1, Count=lng)  # -> simplify(Series)
int = Integer(series)
neg = Negative(Value=int)
eval = EvaluateCurve(Curve=graft(crv_2), Parameter=int)  # -> Point, Tangent, Angle
eval_2 = EvaluateCurve(Curve=graft(flip.Curve), Parameter=neg)  # -> Point, Tangent, Angle
pt_intersection_nodes = Point(eval.Point)

intcrv = Interpolate(Vertices=explode.Vertices, Degree=3, Periodic=False, KnotStyle=1)  # -> Curve, Length, Domain
nurbs = NurbsCurve(Vertices=explode.Vertices, Degree=3, Periodic=False)  # -> Curve, Length, Domain
crvgraph = CurvatureGraph(Curve=intcrv.Curve, Density=5, Scale=Slider(103, range=0..120))
crossref = CrossReference(ListA=graft(pt_kn), ListB=eval.Point, CrossMode=1)  # -> ListA, ListB

amp = Amplitude(Vector=eval_2.Tangent, Amplitude=simplify(crossref.ListA))
amp_2 = Amplitude(Vector=eval.Tangent, Amplitude=simplify(crossref.ListA))
addition = Addition(A=amp_2, B=amp)
vdis = VectorDisplay(Anchor=pt_intersection_nodes, Vector=amp)
vdis_2 = VectorDisplay(Anchor=pt_intersection_nodes, Vector=amp_2)
vec_pt_force = Vector(addition)
vdis_3 = VectorDisplay(Anchor=pt_intersection_nodes, Vector=vec_pt_force)

item = ListItem(List=reverse(amp_2), Index=0, Wrap=True)
item_2 = ListItem(List=reverse(eval.Point), Index=0, Wrap=True)
item_3 = ListItem(List=eval_2.Point, Index=0, Wrap=True)
item_4 = ListItem(List=amp, Index=0, Wrap=True)
vdis_endforce = VectorDisplay(Anchor=item_2, Vector=item)
vdis_endforce_2 = VectorDisplay(Anchor=item_3, Vector=item_4)
merge = Merge(Data1=item, Data2=item_4)
pt_intersection_nodes_2 = Point(pt_intersection_nodes)
vec_end_force = Vector(merge)
vec_pt_force_2 = Vector(addition)
vec_end_force_2 = ClusterOutput(vec_end_force)
move = Move(Geometry=pt_intersection_nodes_2, Motion=vec_pt_force_2)  # -> Geometry, Transform

# ---- group: pair up curve intersection points by index, returns uniques
vec_pt_force_3 = Vector(flatten(vec_pt_force))
pt = Point(flatten(pt_intersection_nodes))
rdpoints = RemoveDuplicatePointsKaramba3D(Point=pt, LimitDistance=0.005)  # -> OutPoint, Info, Indexes
item_5 = ListItem(List=pt, Index=rdpoints.Indexes, Wrap=True)
cp = ClosestPoint(Point=item_5, Cloud=pt)  # -> ClosestPoint, simplify(graft(CPIndex)), Distance
merge_2 = Merge(Data1=simplify(graft(rdpoints.Indexes)), Data2=cp.CPIndex)
item_6 = ListItem(List=vec_pt_force_3, Index=merge_2, Wrap=True)
item_7 = ListItem(List=pt, Index=merge_2, Wrap=True)
ma = MassAddition(Input=item_6)  # -> Result, PartialResults
item_8 = ListItem(List=item_7, Index=0, Wrap=True)
vdisex = VectorDisplayEx(Point=item_8, Vector=ma.Result, Colour=RGB(0, 0, 0), Width=Slider(3, range=0..10))

# ----
pline = PolyLine(Vertices=move.Geometry, Closed=False)  # disabled
curve = Curve(pline)  # disabled
pt_intersection_nodes_3 = ClusterOutput(pt_intersection_nodes_2)
vec_pt_force_4 = ClusterOutput(vec_pt_force_2)

# ==== cluster EmbedCables
segments = ClusterInput()
cables = ClusterInput()
segments_2 = Surface(simplify(segments))
cables_2 = Curve(cables)
surface_curve = SurfaceCurve(Surface=segments_2, Curve=flatten(cables_2))  # -> simplify(Curves), Points, UVPoints, Normals, Parameters, Tangents
trim = TrimTree(Tree=surface_curve.Curves, Depth=1)
srfsplit = SurfaceSplit(Surface=segments_2, Curves=trim)
trim_2 = TrimTree(Tree=srfsplit, Depth=1)
split_segments = Geometry(trim_2)
split_cables = Geometry(trim)
split_segments_2 = ClusterOutput(split_segments)
split_cables_2 = ClusterOutput(split_cables)

# ==== cluster Karamba
springs = ClusterInput()
mesh = ClusterInput()
springs_2 = Line(springs)
mesh_2 = Mesh(mesh)
number_slider = Slider(3, range=0..10)

panel = Panel("main direction")
_10º = PowerOf10(Value=Slider(-4, range=-6..10))
multiplication = Multiplication(A=Slider(1, range=1..10), B=_10º)

mesh_3 = Mesh(mesh_2)
mjoin = MeshJoin(Meshes=mesh_3)
_10º_2 = PowerOf10(Value=Slider(5, range=0..10))
_10º_3 = PowerOf10(Value=number_slider)
_10º_4 = PowerOf10(Value=Slider(5, range=0..10))
_10º_5 = PowerOf10(Value=Slider(2, range=0..10))
_10º_6 = PowerOf10(Value=Slider(5, range=0..10))
_10º_7 = PowerOf10(Value=Slider(1, range=0..10))
_10º_8 = PowerOf10(Value=Slider(5, range=0..10))
multiplication_2 = Multiplication(A=Slider(1, range=0..1), B=_10º_4)
multiplication_3 = Multiplication(A=Slider(1, range=0..1), B=_10º_2)
multiplication_4 = Multiplication(A=Slider(1, range=0..1), B=_10º_6)
multiplication_5 = Multiplication(A=Slider(1, range=0..1), B=_10º_7)
multiplication_6 = Multiplication(A=Slider(1, range=0..1), B=_10º_5)
multiplication_7 = Multiplication(A=Slider(1, range=1..10), B=_10º_3)
multiplication_8 = Multiplication(A=Slider(1, range=0..1), B=_10º_8)
vec = VectorXYZ(XComponent=multiplication_2, YComponent=multiplication_4, ZComponent=multiplication_3)  # -> Vector, Length
# spring setup
vec_2 = VectorXYZ(XComponent=multiplication_7, YComponent=multiplication_7, ZComponent=multiplication_7)  # -> Vector, Length
vec_3 = VectorXYZ(XComponent=multiplication_5, YComponent=multiplication, ZComponent=multiplication_6)  # -> Vector, Length
vec_4 = VectorXYZ(XComponent=multiplication_8, YComponent=multiplication_8, ZComponent=multiplication_8)  # -> Vector, Length
cross_section = CrossSectionKaramba3D(
    FamilyNameOfCrossSection="DefaultCroSec",
    ElementIdentifier="spring",
    CTranslation_kN_m=vec.Vector,
    CRotation_kNm_rad=vec_3.Vector,
    mode="Spring")
merge = Merge(Data2=cross_section)
crosec = CrossSectionKaramba(merge)
number_slider_2 = Slider(9.862, range=0..10)  # "kN/m2"
number_slider_3 = Slider(6.44, range=0..100)
Z = UnitZ(Factor=Slider(10, range=0..10))
rev = Reverse(Vector=Z)
cross_section_2 = CrossSectionKaramba3D(
    FamilyNameOfCrossSection="DefaultCroSec",
    Material=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,
    Height_cm=Slider(5, range=0..10),
    mode="Shell - Const")
loads = LoadsKaramba3D(Vector=rev, Mesh=mesh_2, mode="MeshLoad -Const.", menu=[buttons(off, on, off), buttons(on, on)])
bottompoints = BottomPoints(mesh=mesh_2, ltol=Slider(2, range=0..10))  # -> flatten(pt_3)
supp = SupportKaramba3D(PosInd=bottompoints, menu=[buttons(on, on, on, off, off, on)])
linetobeam = LineToBeamKaramba(Line=flatten(springs_2), Identifier="spring", New=True, Remove=True, LimitDistance_m=0.005)  # -> simplify(Element), Points, Info
loads_2 = LoadsKaramba3D(Vector=Vector(0, 0, -1), mode="Gravity")
matselect = MaterialSelectionKaramba3D(menu=[dropdown(3), dropdown(1)])
panel_2 = Panel(loads)
meshtoshell = MeshToShellKaramba3D(Mesh=mesh_2, LimitDistance_m=0.005)  # -> Element, flatten(Points), Info
merge_2 = Merge(Data1=flatten(linetobeam.Element), Data2=flatten(meshtoshell.Element))
element = ElementKaramba(merge_2)
pt = Point(meshtoshell.Points)
mag_ct = Integer(number_slider)
rec = DataRecorder(mag_ct, DataLimit=-10, RecordData=False)
quick_graphs = QuickGraphs()

# ---- group: live load patterns
mesh_4 = Mesh(simplify(graft(mesh_3)))
image = ImageSampler(Filter="Colour", Interpolate=False, Umax=1, Umin=0, Vmax=1, Vmin=0, Wrap=1)
load_pattern = Slider(7, range=1..7)
bbox = BoundingBox(Content=flatten(mesh_4), Plane=PlaneXY(0, 0, 0), UnionBox=True)  # -> Box, Box_2
faceb = FaceBoundaries(Mesh=mesh_4)  # -> simplify(Boundaries)
box = EvaluateBox(Box=bbox.Box, UParameter=0.5, VParameter=0.5, WParameter="1")  # -> Plane, simplify(Point), Include
pattern_domains = PatternDomains(G=load_pattern)
area = Area(Geometry=faceb)  # -> Area, Centroid
pt_2 = Point(simplify(graft(area.Centroid)))
sph = Sphere(Base=box.Plane, Radius=Slider(2, range=0..10))
polar = ToPolar(Point=pt_2, System=box.Plane)  # -> simplify(Phi), Theta, Radius
wh_value_for_live_load = Panel("3.5")
pt_3 = Point(simplify(area.Centroid))

# ----
data = Data(flatten(pattern_domains))
face_area_m2 = Number(area.Area)
mesh_5 = Mesh(mesh_4)

# ---- group: live load patterns (continued)
dom² = ConstructDomain²(DomainU=data, DomainV="0 To Pi")
subsrf = Isotrim(Surface=sph, Domain=dom²)
inc = Includes(Value=polar.Phi, Domain=data)  # -> Includes, Deviation
ma = MassAddition(Input=inc.Includes)  # -> Result, PartialResults
bool = Boolean(ma.Result)
multiplication_9 = Multiplication(A=number_slider_2, C=bool)
dispatch = Dispatch(List=pt_2, DispatchPattern=bool)  # -> ListA, ListB
live_load_kn_m2_per_face = Number(multiplication_9)
outside = Point(dispatch.ListB)
inside = Point(dispatch.ListA)
Z_2 = UnitZ(Factor=live_load_kn_m2_per_face)
rev_2 = Reverse(Vector=Z_2)

# ----
multiplication_10 = Multiplication(A=live_load_kn_m2_per_face, B=face_area_m2)  # disabled
trim = TrimTree(Tree=rev_2, Depth=1)

# ---- group: live load patterns (continued)
vdis = VectorDisplay(Anchor=pt_3, Vector=trim)
loads_3 = LoadsKaramba3D(Vectors=trim, Mesh=mesh_5, mode="MeshLoad -Variable", menu=[buttons(off, on, off), buttons(on, on)])

# ----
load = LoadKaramba3D(flatten(loads_3))
panel_3 = Panel(load)

# ----
# Karamba analysis
# and results
assemble = AssembleModelKaramba3D(Point=pt, Elem=element, Support=supp, Load=load, CrossSection=crosec, Material=matselect, LimitDistance_m=0.005)  # -> Model, Info, Mass_kg, CenterOfGravity
analyze = AnalyzeKaramba3D(Model=assemble.Model)  # -> CalculatedModel, MaximumDisplacement_cm, ResultingForceOfGravity_kN, ElasticEnergy_kNm
modelview = ModelViewKaramba3D(Model=analyze.CalculatedModel, ResultFactors=1, ResultCase=-1)  # -> Model, DeformedMesh, DeformedAxes, DeformedModel
medges = MeshEdges(Mesh=modelview.DeformedMesh)  # -> NakedEdges, InteriorEdges, NonManifoldEdges

analyzethii = AnalyzeThIIKaramba3D(Model=assemble.Model, RTolerance=1e-07, MaxIterations=50, NoTensionalNII=False)  # -> CalculatedModel, MaximumDisplacement_cm, ResultingForceOfGravity_kN, ElasticEnergy_kNm; disabled
bmodes = BucklingModesKaramba3D(
    Model=analyzethii.CalculatedModel,
    FromIndex=1,
    NumberOfModes=Slider(3, range=0..10),
    MaximumNumberOfIterations=300,
    Epsilon=1e-07)  # -> ModelWithBucklingModesAsLoadCaseResults, BucklingLoadFactors
beamview = BeamViewKaramba3D(Model=modelview.Model)  # -> Model, MeshesOfRenderedBeams, DeformedBeamAxes, LegendColors, LegendTags; disabled
panel_4 = Panel(bmodes.BucklingLoadFactors)
shellview = ShellViewKaramba3D(Model=modelview.Model, IndexOfLayer=0)  # -> Model, MeshesOfRenderedShells, LegendColors, LegendTags
crv = Curve(modelview.DeformedAxes)
explode = Explode(Curve=simplify(crv), Recursive=True)  # -> Segments, Vertices
legend = Legend(Colour=shellview.LegendColors, Tags=shellview.LegendTags, LegendType=1)
item = ListItem(List=explode.Segments, Index=Slider(0, range=0..1), Wrap=True)
end = EndPoints(Curve=item)  # -> Start, End
item_2 = ListItem(List=reverse(shellview.LegendTags), Index=0, Wrap=True)  # -> Item, Item1
item_3 = ListItem(List=shellview.LegendTags, Index=0, Wrap=True)  # -> Item, Item1
panel_5 = Panel(item_3.Item1)
panel_6 = Panel(item_2.Item1)
scale = Scale(Geometry=item, Center=end.Start, Factor=Slider(0.02, range=0..0.1))  # -> Geometry, Transform
model = ModelKaramba3D(modelview.Model)
crv_2 = Curve(medges.NakedEdges)
mesh_6 = Mesh(modelview.DeformedMesh)
merge_viz = Merge(Data1=crv_2, Data2=model, Data3=mesh_6, Data4=scale.Geometry)
viz_springs = VizSprings(spring_line=scale.Geometry, scale=Slider(0.5, range=0..1))
max_stress_comp = Number(item_3.Item1)
max_stress_tens = Number(item_2.Item1)
max_disp = Number(analyze.MaximumDisplacement_cm)
geo = Geometry(viz_springs)
rec_2 = DataRecorder(max_stress_tens, DataLimit=-10, RecordData=False)
rec_3 = DataRecorder(max_stress_comp, DataLimit=-10, RecordData=False)
rec_4 = DataRecorder(max_disp, DataLimit=-10, RecordData=False)

# ==== cluster MeshSegments
offset_segments = ClusterInput()
mesh_resolution = ClusterInput()
mesh_resolution_2 = Number(mesh_resolution)
offset_segments_2 = Surface(simplify(offset_segments))
# IPts not working on trimmed surface
number_slider = Slider(3, range=0..10)
smooth = SettingsQuality()
mesh_breps = MeshBrepsKaramba3D(
    Brep=offset_segments_2,
    MeshResolution=mesh_resolution_2,
    EdgeRefinementFactor=0.67,
    PointReduction=False,
    SmoothingStepSize=Slider(1, range=0..1),
    SmoothingIterations=number_slider)  # -> simplify(Mesh), Info
custom_mesh_settings = SettingsCustom(
    StitchSeams=True,
    SimplePlanes=False,
    Refine=True,
    MinCount=16,
    MaxCount=400,
    AspectRatio=20,
    MaxDistance=0,
    MaxAngle=20,
    MinEdge=0,
    MaxEdge=0)
medges = MeshEdges(Mesh=mesh_breps.Mesh)  # -> NakedEdges, InteriorEdges, NonManifoldEdges
mesh = MeshBrep(Brep=offset_segments_2, Settings=custom_mesh_settings)
mjoin = MeshJoin(Meshes=mesh_breps.Mesh)
panel = Panel(offset_segments_2)
crv = Curve(medges.NakedEdges)
mesh_2 = Mesh(mjoin)
mesh_3 = ClusterOutput(mesh_2)

# ==== cluster WIPAlternativeOffsetMeshing
segments = ClusterInput()

# ---- group: determine internal edges + topology
segments_2 = Surface(segments)
join = BrepJoin(Breps=segments_2)  # -> Breps, Closed
debrep = DeconstructBrep(Brep=join.Breps)  # -> Faces, Edges, Vertices
topology = BrepTopology(Brep=join.Breps, PerspectiveOnly=False)  # -> FaceFaceAdjacency, simplify(FaceEdgeAdjacency), simplify(EdgeFaceAdjacency)
lng = ListLength(List=topology.EdgeFaceAdjacency)
larger = LargerThan(FirstNumber=lng, SecondNumber="1")  # -> LargerThan, OrEqualTo
dispatch = Dispatch(List=topology.EdgeFaceAdjacency, DispatchPattern=larger.LargerThan)  # -> ListA, ListB
clean = CleanTree(RemoveNulls=True, RemoveInvalid=True, RemoveEmpty=Toggle(True), Tree=dispatch.ListA)
tstat = TreeStatistics(Tree=clean)  # -> Paths, Length, Count
dpath = DeconstructPath(Branch=tstat.Paths)
item = ListItem(List=debrep.Edges, Index=flatten(dpath), Wrap=True)
match = MatchTree(Tree=graft(item), Guide=clean)
adjacent_faces = Integer(clean)
internal_edges = Curve(match)

# ----
offset_segments = ClusterInput()
number_slider = Slider(18, range=0..100)
offset_segments_2 = Surface(simplify(offset_segments))
debrep_2 = DeconstructBrep(Brep=offset_segments_2)  # -> Faces, Edges, Vertices
item_2 = ListItem(List=debrep.Edges, Index=number_slider, Wrap=True)
divint = DivInt(crv=debrep_2.Edges, num=Slider(0.322, range=0..1))  # -> pts_2, midpts_2
branch = TreeBranch(Tree=internal_edges, Path=number_slider, MaintainPaths=True)
int = Integer(simplify(graft(topology.FaceEdgeAdjacency)))
number_slider_2 = Slider(5, range=0..10)
divint_2 = DivInt(crv=debrep.Edges, num=Slider(0.322, range=0..1))  # -> pts_2, midpts_2
debrep_3 = DeconstructBrep(Brep=offset_segments_2)  # -> Faces, Edges, Vertices
nullrep = ReplaceNulls(Items=divint_2.pts_2)  # -> Items, Count
join_2 = JoinCurves(Curves=debrep_3.Edges, Preserve=False)  # -> simplify(Curves)
group = Group(Objects=divint_2.pts_2)
branch_2 = TreeBranch(Tree=offset_segments_2, Path=number_slider_2, MaintainPaths=True)
item_3 = ListItem(List=flatten(group), Index=int, Wrap=True)
ungroup = Ungroup(Group=item_3)  # -> simplify(Objects)
panel = Panel(int)
trim = TrimTree(Tree=ungroup, Depth=1)
branch_3 = TreeBranch(Tree=trim, Path=number_slider_2, MaintainPaths=True)
crv_cp = CurveClosestPoint(Point=trim, Curve=join_2)  # -> Point, Parameter, Distance
srf_cp = SurfaceClosestPoint(Point=trim, Surface=offset_segments_2)  # -> Point, UVPoint, Distance

# ==== cluster MultiPatchGH
shell_plan = ClusterInput()
bay_geometry = ClusterInput()
shell_plan_2 = Curve(shell_plan)
bay_geometry_2 = Geometry(bay_geometry)
explode = Explode(Curve=bay_geometry_2, Recursive=True)  # -> graft(Segments), Vertices
intcrv = Interpolate(Vertices=explode.Vertices, Degree=3, Periodic=Toggle(True), KnotStyle=1)  # -> Curve, Length, Domain
boundary = BoundarySurfaces(Edges=intcrv.Curve)
area = Area(Geometry=intcrv.Curve)  # -> Area, Centroid
extr = ExtrudePoint(Base=flatten(intcrv.Curve), Point=area.Centroid)
srf_cp = SurfaceClosestPoint(Point=explode.Vertices, Surface=reparameterize(extr))  # -> Point, UVPoint, Distance
pdecon = Deconstruct(Point=srf_cp.UVPoint)  # -> XComponent, YComponent, ZComponent
cull_i = CullIndex(List=pdecon.YComponent, Indices="0", Wrap=True)
cull_i_2 = CullIndex(List=cull_i, Indices="-1", Wrap=True)
merge = Merge(Data1=flatten("0"), Data2=flatten(cull_i_2), Data3=flatten("1"))
consec = ConsecutiveDomains(Numbers=merge, Additive=False)
dom = ConstructDomain(DomainStart=0, DomainEnd=1)
panel = Panel(consec)
dom² = ConstructDomain²(DomainU=dom, DomainV=consec)
divide = DivideDomain²(Domain=extr, UCount=Slider(1, range=0..10), VCount=Slider(10, range=0..10))
subsrf = Isotrim(Surface=reparameterize(extr), Domain=dom²)  # -> simplify(graft(Surface))
srfsplit = SurfaceSplit(Surface=subsrf, Curves=shell_plan_2)  # -> simplify(Fragments)
area_2 = Area(Geometry=srfsplit)  # -> Area, Centroid
sort = SortList(Keys=area_2.Area, ValuesA=srfsplit)  # -> Keys, ValuesA
item = ListItem(List=reverse(sort.ValuesA), Index=0, Wrap=True)  # -> flatten(Item)

# ---- group: isolines
number_slider = Slider(8, range=0..10)
number_slider_2 = Slider(9, range=0..10)
number_slider_3 = Slider(7, range=0..10)
one_over_x = OneOverX(Value=number_slider)
one_over_x_2 = OneOverX(Value=number_slider_2)
one_over_x_3 = OneOverX(Value=number_slider_3)
recgrid = Rectangular(Plane=PlaneXY(0, 0, 0), SizeX=one_over_x_3, SizeY=one_over_x_2, ExtentX=number_slider_3, ExtentY=number_slider_2)  # -> Cells, Points
sqgrid = Square(Plane=PlaneXY(0, 0, 0), Size=one_over_x, ExtentX=number_slider, ExtentY=number_slider)  # -> Cells, graft(Points)
iso = IsoCurve(Surface=reparameterize(item), UVPoint=sqgrid.Points)  # -> UIsocurve, VIsocurve

# ----
md_slider = MDSlider(
    SliderMode=0,
    slider_value=Point(0.8889428115, 0.7862578601, 0.5),
    x_domain=Domain(0, 1),
    y_domain=Domain(0, 1),
    z_domain=Domain(0, 1))
evalsrf = EvaluateSurface(Surface=reparameterize(item), Point=md_slider)  # -> Point, Normal, UDirection, VDirection, Frame
join = BrepJoin(Breps=item)  # -> Breps, Closed
_4_piece = Surface(item)

int = Integer(Slider(18, range=0..100))
one_over_x_4 = OneOverX(Value=int)
sqgrid_2 = Square(Plane=PlaneXY(0, 0, 0), Size=one_over_x_4, ExtentX=int, ExtentY=int)  # -> Cells, Points
iso_2 = IsoCurve(Surface=reparameterize(_4_piece), UVPoint=simplify(graft(sqgrid_2.Points)))  # -> UIsocurve, VIsocurve

_4_piece_2 = ClusterOutput(_4_piece)

# ==== cluster WIPCompLoadsReactions
model = ClusterInput()
model_2 = ModelKaramba3D(model)
disassemble = DisassembleModelKaramba3D(Model=model_2)  # -> Model, Point, Beam, Shell, Support, Load, Line, Mesh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
react = ReactionForcesKaramba3D(AnalyzedModel=model_2, ResultCase=0)  # -> AnalyzedModel, ReactionForces_kN, ReactionMoments_kNm, SupportPosition, SumOfReactionForces_kN, SumOfReactionMoments_kNm
disassemble_2 = DisassembleElementKaramba3D(Element=disassemble.Shell)  # -> Element, ElementIdentifier, AxisOfElement, CrossSection, Joints, Material, LocalCoordinateSystem, ElementIsActive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
pdecon = Deconstruct(Point=react.SumOfReactionForces_kN)  # -> XComponent, YComponent, ZComponent
cull_i = CullIndex(List=disassemble.Load, Indices="-1", Wrap=True)
area = Area(Geometry=disassemble.Mesh)  # -> Area, Centroid
vertical_reaction_sum_kn = Number(pdecon.ZComponent)
dismload = DisassembleMeshLoadKaramba3D(MeshLoad=cull_i)  # -> PointLoad, ElementLoad
vertical_reaction_sum_kn_2 = ClusterOutput(vertical_reaction_sum_kn)
panel = Panel(disassemble.Load)

# ==== cluster SurfGriller
grid_lines = ClusterInput()
surface = ClusterInput()
grid_lines_2 = Number(grid_lines)
one_over_x = OneOverX(Value=grid_lines_2)
surface_2 = Surface(surface)
sqgrid = Square(Plane=PlaneXY(0, 0, 0), Size=one_over_x, ExtentX=grid_lines_2, ExtentY=grid_lines_2)  # -> Cells, flatten(Points)
iso = IsoCurve(Surface=reparameterize(simplify(graft(surface_2))), UVPoint=sqgrid.Points)  # -> UIsocurve, VIsocurve
merge = Merge(Data1=surface_2, Data2=iso.UIsocurve, Data3=iso.VIsocurve)  # -> flatten(Result)
grilled_surface = Geometry(merge)
grilled_surface_2 = ClusterOutput(grilled_surface)

# ==== cluster IntersectStressLines
stress_lines = ClusterInput()
stress_lines_2 = Curve(stress_lines)
bang = ExplodeTree(Data=stress_lines_2)  # -> Branch0, Branch1
edge_cables = Curve(bang.Branch1)
corner_cables = Curve(bang.Branch0)
crossref = CrossReference(ListA=corner_cables, ListB=edge_cables, CrossMode=1)  # -> ListA, ListB
ccx = CurveCurve(CurveA=crossref.ListA, CurveB=crossref.ListB)  # -> Points, ParamsA, ParamsB
intersection_points = Point(ccx.Points)
intersection_points_2 = ClusterOutput(intersection_points)

# ==== cluster JigglePoints
maximum_deviation = ClusterInput()
intersection_points = ClusterInput()
curves_to_snap = ClusterInput()
rho_values = ClusterInput()
phi_values = ClusterInput()
intersection_points_2 = Point(flatten(intersection_points))
curves_to_snap_2 = Curve(curves_to_snap)
phi_values_2 = Number(phi_values)
maximum_deviation_2 = Number(maximum_deviation)
rho_values_2 = Number(rho_values)
pt = Point(simplify(graft(intersection_points_2)))
lot = Integer(Slider(2, range=0..10))
neg = Negative(Value=lot)
crv_cp = CurveClosestPoint(Point=pt, Curve=curves_to_snap_2)  # -> Point, Parameter, Distance
_10º = PowerOf10(Value=neg)
smaller = SmallerThan(FirstNumber=crv_cp.Distance, SecondNumber=_10º)  # -> SmallerThan, OrEqualTo
pt_2 = Point(pt)
dispatch = Dispatch(List=pt, DispatchPattern=smaller.SmallerThan)  # -> simplify(ListA), simplify(ListB)
bbox = BoundingBox(Content=flatten(pt_2), Plane=PlaneXY(0, 0, 0), UnionBox=True)  # -> Box, Box_2
edges = BrepEdges(Brep=bbox.Box)  # -> Naked, Interior, NonManifold
pt_on_curve = Point(dispatch.ListA)
pt_off_curve = Point(dispatch.ListB)
end = EndPoints(Curve=edges.Naked)  # -> Start, End
phi = Number(graft(phi_values_2))
toggle = BooleanToggle(False)
cp = ClosestPoint(Point=pt_2, Cloud=end.Start)  # -> ClosestPoint, CPIndex, Distance
max_phi = Slider(1, range=1..2)
round = Round(Number=phi)  # -> Nearest, Floor, Ceiling
Z = UnitZ(Factor=1)
vec2pt = Vector2Pt(PointA=pt_2, PointB=cp.ClosestPoint, Unitize=toggle)  # -> Vector, Length
cir = Circle(Plane=pt, Radius=maximum_deviation_2)
crossref = CrossReference(ListA=pt_off_curve, ListB=round.Nearest, CrossMode=3)  # -> ListA, ListB
crossref_2 = CrossReference(ListA=pt_on_curve, ListB=phi, CrossMode=3)  # -> ListA, ListB
radius = Number(graft(rho_values_2))
xprod = CrossProduct(VectorA=vec2pt.Vector, VectorB=Z, Unitize=toggle)  # -> Vector, Length
merge = Merge(Data1=crossref_2.ListB, Data2=crossref.ListB)
pi = Pi(Factor=max_phi)
pl = ConstructPlane(Origin=pt_2, XAxis=vec2pt.Vector, YAxis=xprod.Vector)
remap = RemapNumbers(Value=merge, Source=Domain(0, 1), Target=pi)  # -> Mapped, Clipped
remap_2 = RemapNumbers(Value=radius, Source=Domain(0, 1), Target=maximum_deviation_2)  # -> Mapped, Clipped
deviation_spaces = Curve(cir)
pt_3 = PointPolar(BasePlane=pl, XYAngle=remap.Mapped, ZAngle=0, Offset=remap_2.Mapped)
jiggled_points = Point(pt_3)
jiggled_points_2 = ClusterOutput(jiggled_points)

# ==== cluster MakeSegments
tolerance = ClusterInput()
stress_lines = ClusterInput()
tolerance_2 = Number(tolerance)
stress_lines_2 = Curve(stress_lines)
bang = ExplodeTree(Data=stress_lines_2)  # -> Branch0, Branch1
intersection_points = ClusterInput()
lot = Integer(Slider(0, range=0..10))
neg = Negative(Value=lot)
intersection_points_2 = Point(flatten(intersection_points))
corner_lines = Curve(bang.Branch0)
edge_lines = Curve(bang.Branch1)
_10º = PowerOf10(Value=neg)
# tolerance same as max deviation because maxDev is being set do that circles do not intersect - needs improvement
tolerance_3 = Number(tolerance_2)
crv_cp = CurveClosestPoint(Point=intersection_points_2, Curve=graft(corner_lines))  # -> Point, Parameter, Distance
crv_cp_2 = CurveClosestPoint(Point=intersection_points_2, Curve=graft(edge_lines))  # -> Point, Parameter, Distance
smaller = SmallerThan(FirstNumber=crv_cp.Distance, SecondNumber=tolerance_3)  # -> SmallerThan, OrEqualTo
smaller_2 = SmallerThan(FirstNumber=crv_cp_2.Distance, SecondNumber=tolerance_3)  # -> SmallerThan, OrEqualTo
dispatch = Dispatch(List=intersection_points_2, DispatchPattern=smaller_2.SmallerThan)  # -> ListA, ListB
dispatch_2 = Dispatch(List=intersection_points_2, DispatchPattern=simplify(smaller.SmallerThan))  # -> ListA, ListB
pt_on_curve = Point(simplify(dispatch_2.ListA))
pt_on_curve_2 = Point(simplify(dispatch.ListA))
alongcrv = SortAlongCurve(Points=pt_on_curve, Curve=simplify(graft(corner_lines)))  # -> simplify(Points), Indices
alongcrv_2 = SortAlongCurve(Points=pt_on_curve_2, Curve=simplify(graft(edge_lines)))  # -> simplify(Points), Indices
pline = PolyLine(Vertices=alongcrv.Points, Closed=False)
pline_2 = PolyLine(Vertices=alongcrv_2.Points, Closed=False)
entwine = Entwine(Branch00=pline, Branch01=pline_2, FlattenInputs=True)  # -> simplify(Result)
segment_plans = Curve(entwine)
segment_plans_2 = ClusterOutput(segment_plans)

# ==== cluster MakeKeystone
surface_plan = ClusterInput()
intersection_points = ClusterInput()
surface_plan_2 = Curve(surface_plan)
intersection_points_2 = Point(intersection_points)
explode = Explode(Curve=surface_plan_2, Recursive=True)  # -> Segments, Vertices
lng = ListLength(List=explode.Segments)
division = Division(A=lng, B=2)
area = Area(Geometry=surface_plan_2)  # -> Area, Centroid
center = Point(area.Centroid)
cps = ClosestPoints(Point=center, Cloud=flatten(intersection_points_2), Count=division)  # -> ClosestPoint, CPIndex, Distance
cir = Circle(Plane=center, Radius=1)
alongcrv = SortAlongCurve(Points=cps.ClosestPoint, Curve=cir)  # -> Points, Indices
pline = PolyLine(Vertices=alongcrv.Points, Closed=Toggle(True))
keystone_plan = Curve(pline)
keystone_plan_2 = ClusterOutput(keystone_plan)

# ==== cluster BoxSize
box = ClusterInput()
box_2 = Box(box)
debox = DeconstructBox(Box=box_2)  # -> Plane, X, Y, Z
dedomain = DeconstructDomain(Domain=debox.X)  # -> Start, End
dedomain_2 = DeconstructDomain(Domain=debox.Y)  # -> Start, End
dedomain_3 = DeconstructDomain(Domain=debox.Z)  # -> Start, End
subtraction = Subtraction(A=dedomain_2.End, B=dedomain_2.Start)
subtraction_2 = Subtraction(A=dedomain.End, B=dedomain.Start)
subtraction_3 = Subtraction(A=dedomain_3.End, B=dedomain_3.Start)
Y = Number(subtraction)
X = Number(subtraction_2)
Z = Number(subtraction_3)
multiplication = Multiplication(A=X, B=Y)
multiplication_2 = Multiplication(A=multiplication, B=Z)
V = Number(multiplication_2)
A = Number(multiplication)
Y_2 = ClusterOutput(Y)
X_2 = ClusterOutput(X)
Z_2 = ClusterOutput(Z)
V_2 = ClusterOutput(V)
A_2 = ClusterOutput(A)

# ==== cluster TestSurface
number_slider = Slider(3, range=0..10)
srf = Surface(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)
scale_nu = ScaleNU(Geometry=srf, Plane=PlaneXY(0, 0, 0), ScaleX=1, ScaleY=1, ScaleZ=Slider(1.042, range=0..5))  # -> Geometry, Transform
panel = Panel("1")
srf_2 = Surface(scale_nu.Geometry)
divide = DivideDomain²(Domain=srf_2, UCount=number_slider, VCount=number_slider)
subsrf = Isotrim(Surface=reparameterize(srf_2), Domain=divide)
S = ClusterOutput(subsrf)

# ==== cluster SpringAngles
crv = ClusterInput()
crv_2 = Curve(crv)
end = EndPoints(Curve=crv_2)  # -> Start, End
xy = XYPlane(Origin=end.Start)
project = Project(Geometry=crv_2, Plane=xy)  # -> Geometry, Transform
end_2 = EndPoints(Curve=project.Geometry)  # -> Start, End
vec2pt = Vector2Pt(PointA=end_2.Start, PointB=end_2.End, Unitize=False)  # -> Vector, Length
vec2pt_2 = Vector2Pt(PointA=end.Start, PointB=end.End, Unitize=False)  # -> Vector, Length
angle = Angle(VectorA=vec2pt_2.Vector, VectorB=vec2pt.Vector)  # -> Angle, Reflex
deg = Degrees(Radians=angle.Angle)
panel = Panel(deg)
sort = SortList(Keys=flatten(deg))  # -> Keys, ValuesA
bnd = Bounds(Numbers=sort.Keys)
panel_2 = Panel(bnd)

# ==== cluster BottomPoints
ltol = ClusterInput()
mesh = ClusterInput()
mesh_2 = Mesh(mesh)
ltol_2 = Integer(ltol)
demesh = DeconstructMesh(Mesh=mesh_2)  # -> Vertices, Faces, Colours, Normals
pt = Point(flatten(demesh.Vertices))
bbox = BoundingBox(Content=pt, Plane=PlaneXY(0, 0, 0), UnionBox=True)  # -> Box, Box_2
box = EvaluateBox(Box=bbox.Box, UParameter="0", VParameter="0", WParameter="0")  # -> Plane, Point, Include
neg = Negative(Value=ltol_2)
_10º = PowerOf10(Value=neg)
cp = PlaneClosestPoint(Point=pt, Plane=box.Plane)  # -> Point, UVPoint, Distance
panel = Panel("1e-10")
smaller = SmallerThan(FirstNumber=cp.Distance, SecondNumber=_10º)  # -> SmallerThan, OrEqualTo
boxdims = BoxDims(box=bbox.Box)  # -> dx_2, dy_2, dz_2
dispatch = Dispatch(List=pt, DispatchPattern=smaller.SmallerThan)  # -> ListA, ListB
duppt = RemoveDuplicatePts(Points=dispatch.ListA, Tolerance=0.01)  # -> simplify(UniquePoints)
division = Division(A=boxdims.dx_2, B="2")
pgroups = PointGroups(Points=duppt, Distance=division)  # -> simplify(Groups), Indices
pt_2 = Point(pgroups.Groups)
pt_3 = ClusterOutput(pt_2)

# ==== cluster PatternDomains

# ---- group: pattern 5
number_slider = Slider(0, range=0..10)
number_slider_2 = Slider(2, range=0..10)
addition = Addition(A=number_slider, B="2")
series = Series(Start=addition, Step="4", Count=number_slider_2)
series_2 = Series(Start=number_slider, Step="4", Count=number_slider_2)
multiplication = Multiplication(A=series_2, B=".25")
multiplication_2 = Multiplication(A=series, B=".25")
pi = Pi(Factor=multiplication_2)
pi_2 = Pi(Factor=multiplication)
panel = Panel(pi_2)
panel_2 = Panel(pi)
dom = ConstructDomain(DomainStart=panel, DomainEnd=panel_2)  # -> graft(Domain)

# ---- group: pattern 6
number_slider_3 = Slider(0, range=0..10)
number_slider_4 = Slider(4, range=0..10)
addition_2 = Addition(A=number_slider_3, B="1")
series_3 = Series(Start=addition_2, Step="2", Count=number_slider_4)
series_4 = Series(Start=number_slider_3, Step="2", Count=number_slider_4)
multiplication_3 = Multiplication(A=series_4, B=".25")
multiplication_4 = Multiplication(A=series_3, B=".25")
pi_3 = Pi(Factor=multiplication_4)
pi_4 = Pi(Factor=multiplication_3)
panel_3 = Panel(pi_4)
panel_4 = Panel(pi_3)
dom_2 = ConstructDomain(DomainStart=panel_3, DomainEnd=panel_4)  # -> graft(Domain)

# ---- group: pattern 4
number_slider_5 = Slider(1, range=0..10)
number_slider_6 = Slider(2, range=0..10)
addition_3 = Addition(A=number_slider_5, B="2")
series_5 = Series(Start=addition_3, Step="4", Count=number_slider_6)
series_6 = Series(Start=number_slider_5, Step="4", Count=number_slider_6)
multiplication_5 = Multiplication(A=series_6, B=".25")
multiplication_6 = Multiplication(A=series_5, B=".25")
pi_5 = Pi(Factor=multiplication_6)
pi_6 = Pi(Factor=multiplication_5)
panel_5 = Panel(pi_6)
panel_6 = Panel(pi_5)
dom_3 = ConstructDomain(DomainStart=panel_5, DomainEnd=panel_6)  # -> graft(Domain)

# ---- group: pattern 1
multiplication_7 = Multiplication(A=Slider(0, range=0..10), B=".25")
multiplication_8 = Multiplication(A=Slider(0, range=0..10), B=".25")
pi_7 = Pi(Factor=multiplication_7)
pi_8 = Pi(Factor=multiplication_8)
panel_7 = Panel(pi_7)
panel_8 = Panel(pi_8)
dom_4 = ConstructDomain(DomainStart=panel_7, DomainEnd=panel_8)

# ---- group: pattern 2
multiplication_9 = Multiplication(A=Slider(2, range=0..10), B=".25")
multiplication_10 = Multiplication(A=Slider(6, range=0..10), B=".25")
pi_9 = Pi(Factor=multiplication_9)
pi_10 = Pi(Factor=multiplication_10)
panel_9 = Panel(pi_9)
panel_10 = Panel(pi_10)
dom_5 = ConstructDomain(DomainStart=panel_9, DomainEnd=panel_10)

# ---- group: pattern 3
multiplication_11 = Multiplication(A=Slider(1, range=0..10), B=".25")
multiplication_12 = Multiplication(A=Slider(5, range=0..10), B=".25")
pi_11 = Pi(Factor=multiplication_11)
pi_12 = Pi(Factor=multiplication_12)
panel_11 = Panel(pi_11)
panel_12 = Panel(pi_12)
dom_6 = ConstructDomain(DomainStart=panel_11, DomainEnd=panel_12)

# ---- group: pattern 7
multiplication_13 = Multiplication(A=Slider(0, range=0..10), B=".25")
multiplication_14 = Multiplication(A=Slider(8, range=0..10), B=".25")
pi_13 = Pi(Factor=multiplication_13)
pi_14 = Pi(Factor=multiplication_14)
panel_13 = Panel(pi_13)
panel_14 = Panel(pi_14)
dom_7 = ConstructDomain(DomainStart=panel_13, DomainEnd=panel_14)

# ----
G = ClusterInput()
filter = StreamFilter(Gate=G, Stream1=dom_4, Stream2=dom_5, Stream3=dom_6, Stream4=dom, Stream5=dom_3, Stream6=dom_2, Stream7=dom_7)
s_7 = ClusterOutput(filter)

# ==== cluster QuickGraphs

# ---- group: whole shell
max_stress_comp = Number(-0.146)
max_stress_tens = Number(0.186)
max_disp = Number(0.03259199848)

# ----
max_stress_comp_2 = Number([-0.736, -0.51, -0.109, -0.151, -0.157, -0.148, -0.147, -0.147, -0.147, -0.147, -0.147])
max_stress_tens_2 = Number([4.69, 3.24, 0.333, 0.164, 0.224, 0.191, 0.184, 0.183, 0.183, 0.183, 0.183])
max_disp_2 = Number([1.58279036, 1.182691614, 0.3778172142, 0.1103610701, 0.05740937502, 0.03608507293, 0.032556884, 0.03216712047, 0.03212689201, 0.03212284776, 0.03212244312])
mag_ct = Integer([0, 1, 2, 3, 4, 5, 6, 7, 8, 9, 10])
merge = Merge(Data1=graft(max_stress_comp_2), Data2=graft(max_stress_tens_2), Data3=graft(max_disp_2))  # -> simplify(Result)
panel = Panel("""max stress comp
max stress tens
max disp""")
merge_2 = Merge(Data1=graft(max_stress_comp), Data2=graft(max_stress_tens), Data3=graft(max_disp))  # -> simplify(Result)
panel_2 = Panel(merge_2)
flip = FlipMatrix(Data=merge)
panel_3 = Panel(flip)
chart = CreateChart(
    ChartName="My Chart",
    ChartSeries=panel,
    ChartXAxisLabels=mag_ct,
    ValueTree=flip,
    Chart_Theme="Bright Pastel",
    Chart_Type="Line")

# ==== cluster VizSprings
spring_line = ClusterInput()
scale = ClusterInput()
spring_line_2 = Geometry(spring_line)
scale_2 = Number(scale)
len = Length(Curve=spring_line_2)
multiplication = Multiplication(A=len, B=scale_2)
division = Division(A=multiplication, B="2")
eval = EvaluateCurve(Curve=reparameterize(spring_line_2), Parameter=".5")  # -> Point, Tangent, Angle
number_slider = Slider(5, range=0..10)
pl = PlaneNormal(Origin=eval.Point, ZAxis=eval.Tangent)
sph = Sphere(Base=pl, Radius=division)
range = Range(Domain=number_slider, Steps=Slider(100, range=0..100))
division_2 = Division(A=range, B=number_slider)
pt = ConstructPoint(XCoordinate=range, YCoordinate=division_2, ZCoordinate=0)
crvsrf = CurveOnSurface(Surface=reparameterize(sph), UVCoordinates=pt, Closed=False)  # -> Curve, Length, Domain
C = ClusterOutput(crvsrf.Curve)

# ==== cluster DivInt
crv = ClusterInput()
num = ClusterInput()

# ---- group: divide curve integer
crv_2 = Curve(crv)
len = Length(Curve=crv_2)
num_2 = Number(num)
division = Division(A=len, B=num_2)
round = Round(Number=division)  # -> Nearest, Floor, Ceiling
divide = DivideCurve(Curve=crv_2, Count=round.Ceiling, Kinks=False)  # -> simplify(Points), Tangents, Parameters

# ----
pline = PolyLine(Vertices=divide.Points, Closed=False)
explode = Explode(Curve=pline, Recursive=True)  # -> Segments, Vertices
eval = EvaluateCurve(Curve=reparameterize(explode.Segments), Parameter=".5")  # -> Point, Tangent, Angle
midpts = Point(simplify(eval.Point))
pts = Point(divide.Points)
pts_2 = ClusterOutput(pts)
midpts_2 = ClusterOutput(midpts)

# ==== cluster BoxDims
box = ClusterInput()
box_2 = Box(box)
debox = DeconstructBox(Box=box_2)  # -> Plane, X, Y, Z
dedomain = DeconstructDomain(Domain=debox.X)  # -> Start, End
dedomain_2 = DeconstructDomain(Domain=debox.Y)  # -> Start, End
dedomain_3 = DeconstructDomain(Domain=debox.Z)  # -> Start, End
subtraction = Subtraction(A=dedomain.End, B=dedomain.Start)
subtraction_2 = Subtraction(A=dedomain_2.End, B=dedomain_2.Start)
subtraction_3 = Subtraction(A=dedomain_3.End, B=dedomain_3.Start)
dx = Number(subtraction)
dy = Number(subtraction_2)
dz = Number(subtraction_3)
dx_2 = ClusterOutput(dx)
dy_2 = ClusterOutput(dy)
dz_2 = ClusterOutput(dz)
